# Dynamo graph AutoFloors_v2.dyn (Dynamo 2.10.1.3976)
# packages: Genius Loci 2021.11.10, archi-lab.net 2022.212.2922

categories = Categories("OST_Rooms")
all_elements_of_category = ElementsOfCategory(Category=categories)
code_block = CodeBlock { "Typ lokalu"; }
getParameterValueByName = Element.GetParameterValueByName(element=all_elements_of_category, parameterName=code_block)
code_block_2 = CodeBlock(x=getParameterValueByName) { (x=="MK"?true:(x=="K"?true:(x=="U"?true:false))); }
filterByBoolMask = List.FilterByBoolMask(list=all_elements_of_category, mask=code_block_2)
code_block_3 = CodeBlock(x=filterByBoolMask.in) { x; }
code_block_4 = CodeBlock { "Finish"; }
boundaries = archilab.Revit.Elements.Room.Boundaries(room=code_block_3, boundaryLocation=code_block_4)
floor_types = FloorTypes("TRE_WEW_Wykonczenie_13cm")
element_level = Custom[Element Level](element=code_block_3)  # package Genius Loci; Gets an element's level. Based on a Clockwork's node
byOutlineTypeAndLevel = Floor.ByOutlineTypeAndLevel(outlineCurves=boundaries.Curves, floorType=floor_types, level=element_level)
