# Dynamo graph BEAM_Join_walls.dyn (Dynamo 2.16.2.5624)

code_block = CodeBlock()  # frozen; unwired: beams, walls
# ---------- code_block.designscript (18 lines) ----------
beams;
walls;
output = [];
z = [Imperative]
{
i = 0;
a = 0;
for (beam in beams)
	{
	for(wall in walls[i])
		{
		output[a] = Revit.Elements.Element.JoinGeometry(beam, wall);
		a = a + 1;
		};
	i = i +1;
	};
return output;
};
# ----------------------------------------

# group: Ściany
categories = Categories("OST_Walls")
all_elements_of_category = ElementsOfCategory(Category=categories)

# group: Stropy
categories_2 = Categories("OST_Floors")
all_elements_of_category_2 = ElementsOfCategory(Category=categories_2)

list_create = List.Create(item0=all_elements_of_category, item1=all_elements_of_category_2)
flatten = List.Flatten(list=list_create)
boundingBox = Element.BoundingBox(element=flatten)

# group: Belki od AKMD
categories_3 = Categories("OST_StructuralFraming")
all_elements_of_category_3 = ElementsOfCategory(Category=categories_3)

boundingBox_2 = Element.BoundingBox(element=all_elements_of_category_3)
code_block_2 = CodeBlock(wallboxes=boundingBox, walls=flatten, beamboxes=boundingBox_2, beams=all_elements_of_category_3)
# ---------- code_block_2.designscript (39 lines) ----------
wallboxes;
walls;
beamboxes;
beams;
colliding = [];
output =[];
z = [Imperative]
{
i = 0;
x = 0;
for (beambox in beamboxes)
	{
		k = 0;
		j = 0;
		for (wallbox in wallboxes)
			{
			if(Autodesk.DesignScript.Geometry.BoundingBox.Intersects(beambox, wallbox))
				{
				colliding[i][j] = walls[k];
				j = j + 1;
				};
			k = k + 1;
			};
		i = i + 1;
	};

p = 0;
d = 0;
for (beam in beams)
	{
	for(aa in colliding[p])
		{
		output[d] = Revit.Elements.Element.JoinGeometry(beam, aa);
		d = d + 1;
		};
	p = p +1;
	};
return output;
};
# ----------------------------------------
code_block_3 = CodeBlock(x=code_block_2.out6) { x; }
