# Dynamo graph COLOUR_Wall_slighlty_off_axis.dyn (Dynamo 2.16.1.2727)
# packages: Bang! 2021.4.3, Clockwork for Dynamo 2.x 2.4.0, Genius Loci 2023.2.21

# group: Colour
boolean = BoolSelector(false)
code_block = CodeBlock { "Wall is slightly off axis"; }
code_block_2 = CodeBlock { 255; 0; }
byARGB = Color.ByARGB(alpha=code_block_2.out0, red=code_block_2.out0, green=code_block_2.out1, blue=code_block_2.out1)
fill_patterns = FillPatterns()  # nothing selected
byProperties = Revit.Filter.OverrideGraphicSettings.ByProperties(cutFillColor=byARGB, projectionFillColor=byARGB, cutLineColor=byARGB, projectionLineColor=byARGB, cutFillPattern=fill_patterns)

# group: Clear overrides
activeViewFromCurrentDocument = Custom[Document.ActiveViewFromCurrentDocument]()  # package Clockwork for Dynamo 2.x; Gets the active view of the current document
categories = Categories("OST_Walls")
all_elements_of_category = ElementsOfCategory(Category=categories)
view_resetelementoverrides = Custom[View ResetElementOverrides](view=activeViewFromCurrentDocument, element=all_elements_of_category)  # package Genius Loci; Removes all Graphics overrides for an element in a given view.

passthrough = Custom[Passthrough](passThrough=boolean, waitFor=view_resetelementoverrides.Element)  # package Clockwork for Dynamo 2.x; Forces a sequential order of execution. The node wired into the output of the Passthrough node will be executed *after* the node wired into the waitFor input (e.g. important for some Revit operations). The value of the passThrough input will be passed on to the node wired into the output port of the Passthrough node.

# group (continued): Colour
# note: Custom Node: Bang
getWarnings = Bang.Revit.Elements.WarningTools.GetWarnings(toggle=passthrough, lacing=Shortest)
contains = String.Contains(string=getWarnings.Warning_Text, searchFor=code_block)
filterByBoolMask = List.FilterByBoolMask(list=getWarnings.Failing_Elements, mask=contains)
transpose = List.Transpose(lists=filterByBoolMask.in)
overrideInView = Element.OverrideInView(element=transpose, overrides=byProperties)
