# Dynamo graph BEAM_copydyn.dyn (Dynamo 2.19.3.6394)
# packages: bimorphNodes 4.2.4, Genius Loci 2023.2.21, Clockwork for Dynamo 2.x 2.4.0, Data-Shapes 2024.2.114, Clockwork for Dynamo 2.x 2.6.0

code_block = CodeBlock { "Skopiuj do modelu"; "Wybierz model z którego skopiujesz wszystkie belki"; }
code_block_2 = CodeBlock { "^(.*?):"; }
reportRevitLinks = Custom[ReportRevitLinks]()  # package Genius Loci; Inspired by Bimorph. Generates a report of all Revit links in the document. Revit links properties are output to facilitate the Revit link model management.
code_block_3 = CodeBlock(RevitLinkReportList=reportRevitLinks.Report)
# ---------- code_block_3.designscript (16 lines) ----------
RevitLinkReportList;


z = [Imperative]{
    i = 0;
    outlist1 = [];
    outlist2 = [];

    for (subElement in RevitLinkReportList) {
        outlist1[i] = subElement[0];
        outlist2[i] = subElement[2];
        i = i + 1;
    }

    return = [outlist1, outlist2];
};
# ----------------------------------------
code_block_4 = CodeBlock(x=code_block_3.out1) { x[0]; x[1]; }
findRegularExpression = Custom[Regex.FindRegularExpression](RegEx=code_block_2, str=code_block_4.out1)  # package Clockwork for Dynamo 2.x; Returns all occurences of a regular expression within a string (or list of strings). The syntax for regular expressions is explained at http://ironpython-test.readthedocs.org/en/latest/howto/regex.html
flatten = List.Flatten(list=findRegularExpression)
dropdown_data = Custom[DropDown Data](Keys=flatten, Values=code_block_4.out0)  # package Data-Shapes; Create data for DropDown input in UI.MultiInputForm ++ . Check out www.data-shapes.net for more infos.
code_block_5 = CodeBlock { true; }
multipleinputform = Custom[MultipleInputForm ++](Description_optional=code_block.out1, ButtonText_optional=code_block.out0, Inputs=dropdown_data, Toggle=code_block_5)  # package Data-Shapes; Create a form with multiple inputs. see www.data-shapes.net for tutorials and infos!
code_block_6 = CodeBlock(x=multipleinputform.User_Inputs) { x; }
categories = Categories("OST_StructuralFraming")
ofCategory = Revit.LinkElement.OfCategory(linkInstance=code_block_6, category=categories)

# group: Zaczekaj na zmianę nazwy i wklej grupę referencyjną (nowa definicja grupy)
copyToActiveDocument = Revit.LinkElement.CopyToActiveDocument(linkElements=ofCategory)

today = DateTime.Today()
code_block_7 = CodeBlock(x=today) { "Belki_"+x; }
code_block_8 = CodeBlock { "."; "_"; }
replace = String.Replace(string=code_block_7, searchFor=code_block_8.out0, replaceWith=code_block_8.out1)
code_block_9 = CodeBlock { " "; }
split = String.Split(string=replace, separator0=code_block_9)
code_block_10 = CodeBlock(x=split) { x[0]; }
fromElements = Custom[Group.FromElements](elements=copyToActiveDocument, groupName=code_block_10)  # package Clockwork for Dynamo 2.x; Creates a group from a list of Revit elements. Unlike the OOTB node, it supports naming the created group directly and also indicates which of the input elements (if any) could not be grouped.
