# Dynamo graph Generator_zestawienia.dyn (Dynamo 2.19.3.6394)
# packages: spring nodes 210.1.1, archi-lab.net 2023.213.1722, bimorphNodes 4.2.4, bimorphNodes 5.1.3, Data-Shapes 2024.2.114, Clockwork for Dynamo 2.x 2.6.0, Genius Loci 2024.5.29, Rhythm 2023.8.2, Clockwork for Dynamo 2.x 2.4.0, Rhythm 2023.5.5

# group: grab links
# Pakujemy tyle linków ile potrzebne
# note: Custom Node: GeniusLociv.2024.5.29
reportRevitLinks = Custom[ReportRevitLinks]()  # package Genius Loci; Inspired by Bimorph. Generates a report of all Revit links in the document. Revit links properties are output to facilitate the Revit link model management.
categories = Categories("OST_Windows")
# note: Custom Node: BimorphNodesv.5.1.3
ofCategory = Revit.LinkElement.OfCategory(linkInstance=reportRevitLinks.RevitLinkInstance, category=categories)
categories_2 = Categories("OST_Doors")
ofCategory_2 = Revit.LinkElement.OfCategory(linkInstance=reportRevitLinks.RevitLinkInstance, category=categories_2)
join = List.Join(list0=ofCategory, list1=ofCategory_2)
flatten = List.Flatten(list=join)

# group: Discriminating param
string = StringInput("Model")

# group: Group
# note: Custom Node: Rhythmv.2024.5.5
ʳʰʸᵗʰᵐ_elements = Rhythm.Revit.Elements.Elements.GetParameterValueByNameTypeOrInstance(parameterName=string)  # unwired: element
groupByFunction = List.GroupByFunction(list=flatten, groupFunction=ʳʰʸᵗʰᵐ_elements)

# group: Get nr [0..x][0]
code_block = CodeBlock { 0; }
getItemAtIndex = List.GetItemAtIndex(list=groupByFunction@L2, index=code_block)

# group: Filter > Grab exisitng sheets
categories_3 = Categories("OST_Sheets")
all_elements_of_category = ElementsOfCategory(Category=categories_3)
name = Element.Name(element=all_elements_of_category)

# group: Filter
# note: Custom Node: BimorphNodesv.5.1.3
elementType = Revit.LinkElement.ElementType(linkElement=getItemAtIndex)
getParameterValueByName = Element.GetParameterValueByName(element=elementType, parameterName=string)
isfloat_sheet_with_such_number = Python(IN[0]=getParameterValueByName, IN[1]=getItemAtIndex, IN[2]=name)  # "isFloat + Sheet with such number doesn't exist yet"; CPython3
# ---------- isfloat_sheet_with_such_number.python (29 lines) ----------
# Load the Python Standard and DesignScript Libraries
import sys
import clr
clr.AddReference('ProtoGeometry')
from Autodesk.DesignScript.Geometry import *

# The inputs to this node will be stored as a list in the IN variables.
i_str = IN[0]
i_list = IN[1]
exclude_list = IN[2]
x = []
a = 0
# Place your code below this line
def isfloat(num):
    try:
        float(num)
        return True
    except ValueError:
        return False

for i in i_str:
    try:
        if not(i in exclude_list) and isfloat(i[:3]):  
            x.append(i_list[a])
        a += 1
    except IndexError:
        a += 1
# Assign your output to the OUT variable.
OUT = x
# ----------------------------------------

# group: Filter > bez leveli out
# note: Custom Node: BimorphNodesv.5.1.3
level = Custom[Element.Level](element=isfloat_sheet_with_such_number)  # package Clockwork for Dynamo 2.x; Gets an element's level
name_2 = Level.Name(level=level)
code_block_2 = CodeBlock(x=name_2) { x == null ?  false : true; }
filterByBoolMask = List.FilterByBoolMask(list=isfloat_sheet_with_such_number, mask=code_block_2)

# group (continued): Filter
passNode = CodeBlock(x=filterByBoolMask.in) { x; }

# group: Bounding boxes / loc
boundingBox = Element.BoundingBox(element=passNode)
code_block_3 = CodeBlock { 0; }
# note: Custom Node: spring nodesv.210.1.1
ꟿ_boundingbox_2drectangle = Custom[ꟿ BoundingBox.2dRectangle](boundingBox=boundingBox, elevation=code_block_3)  # package spring nodes; Returns a 2d rectangle from a bounding box
# note: Custom Node: BimorphNodesv.5.1.3
location = Revit.LinkElement.Location(linkElement=passNode)
code_block_4 = CodeBlock(x=boundingBox) { bb = x; cu = bb.ToCuboid(); cu.Height; }

# group: X Line
# note: Custom Node: spring nodesv.210.1.1
ꟿ_boundingbox_midpoint = Custom[ꟿ BoundingBox.MidPoint](boundingBox=boundingBox)  # package spring nodes; Fetches the mid point of the bounding box.
X = Point.X(point=ꟿ_boundingbox_midpoint)
height = Rectangle.Height(rectangle=ꟿ_boundingbox_2drectangle)
code_block_5 = CodeBlock(x=height) { DSCore.Math.Round(x)/2; }
code_block_6 = CodeBlock(x=X, H=code_block_5) { x + H + 200; }
Y = Point.Y(point=ꟿ_boundingbox_midpoint)
Z = Point.Z(point=location)
code_block_7 = CodeBlock(z=Z) { z - 300; }
byCoordinates = Point.ByCoordinates(x=code_block_6, y=Y, z=code_block_7)
code_block_8 = CodeBlock(x=X, H=code_block_5) { x - H - 200; }
byCoordinates_2 = Point.ByCoordinates(x=code_block_8, y=Y, z=code_block_7)
byStartPointEndPoint = Line.ByStartPointEndPoint(startPoint=byCoordinates, endPoint=byCoordinates_2)

# group: X Axis Section
view_family_types = ViewFamilyTypes("Section 1")
code_block_9 = CodeBlock { 3000; }
code_block_10 = CodeBlock { 500; }
# note: Custom Node: Data-Shapesv.2024.2.114
byLine = Custom[ViewSection.ByLine](Curves=byStartPointEndPoint, ViewFamilyType=view_family_types, ViewSectionHeight=code_block_9, OffsetFromLine=code_block_10, Depth=code_block_10)  # package Data-Shapes; Create ViewSections in current document from DS Lines.

# group: Name part
# note: Custom Node: BimorphNodesv.5.1.3
elementType_2 = Revit.LinkElement.ElementType(linkElement=passNode)
getParameterValueByName_2 = Element.GetParameterValueByName(element=elementType_2, parameterName=string)
code_block_11 = CodeBlock(x=getParameterValueByName_2) { " - " + x; }

# group: Rename
code_block_12 = CodeBlock { "View Name"; }
code_block_13 = CodeBlock(x=getParameterValueByName_2) { "X Axis " + x; }
setParameterByName = Element.SetParameterByName(element=byLine, parameterName=code_block_12, value=code_block_13)
code_block_14 = CodeBlock(x=getParameterValueByName_2) { "Y Axis " + x; }

# note: Custom Node: Clockwork
passthrough = Custom[Passthrough](passThrough=location, waitFor=setParameterByName)  # package Clockwork for Dynamo 2.x; Forces a sequential order of execution. The node wired into the output of the Passthrough node will be executed *after* the node wired into the waitFor input (e.g. important for some Revit operations). The value of the passThrough input will be passed on to the node wired into the output port of the Passthrough node.

# group: Y Line
# note: Custom Node: spring nodesv.210.1.1
ꟿ_boundingbox_midpoint_2 = Custom[ꟿ BoundingBox.MidPoint](boundingBox=boundingBox)
X_2 = Point.X(point=ꟿ_boundingbox_midpoint_2)
Y_2 = Point.Y(point=ꟿ_boundingbox_midpoint_2)
width = Rectangle.Width(rectangle=ꟿ_boundingbox_2drectangle)
code_block_15 = CodeBlock(x=width) { DSCore.Math.Round(x)/2; }
code_block_16 = CodeBlock(y=Y_2, w=code_block_15) { y + w + 200; }
Z_2 = Point.Z(point=passthrough)
code_block_17 = CodeBlock(z=Z_2) { z - 300; }
byCoordinates_3 = Point.ByCoordinates(x=X_2, y=code_block_16, z=code_block_17)
code_block_18 = CodeBlock(y=Y_2, w=code_block_15) { y - w - 200; }
byCoordinates_4 = Point.ByCoordinates(x=X_2, y=code_block_18, z=code_block_17)
byStartPointEndPoint_2 = Line.ByStartPointEndPoint(startPoint=byCoordinates_3, endPoint=byCoordinates_4)

# group: Y Axis Section
view_family_types_2 = ViewFamilyTypes("Section 1")
code_block_19 = CodeBlock { 200; 3000; }
code_block_20 = CodeBlock { 500; }
# note: Custom Node: Data-Shapesv.2024.2.114
byLine_2 = Custom[ViewSection.ByLine](Curves=byStartPointEndPoint_2, ViewFamilyType=view_family_types_2, ViewSectionHeight=code_block_19.out1, OffsetFromLine=code_block_19.out0, Depth=code_block_20)

# group (continued): Rename
setParameterByName_2 = Element.SetParameterByName(element=byLine_2, parameterName=code_block_12, value=code_block_14)

# group: Levels to view by name
code_block_21 = CodeBlock { "Level"; }
# note: Custom Node: BimorphNodesv.5.1.3
getParameterValueByName_3 = Revit.LinkElement.GetParameterValueByName(linkElement=passNode, parameterName=code_block_21)
name_3 = Level.Name(level=getParameterValueByName_3)
# note: Custom Node: GCK
GCKViewsByName = Custom[GCKViewsByName](ViewName=name_3)  # Taken from GeniusLoci

# group: Rec to poly, poly offset, poly to curves
curves = PolyCurve.Curves(polyCurve=ꟿ_boundingbox_2drectangle)
byGroupedCurves = PolyCurve.ByGroupedCurves(curves=curves)
code_block_22 = CodeBlock { 200; false; }
offsetMany = PolyCurve.OffsetMany(polyCurve=byGroupedCurves, signedDistance=code_block_22.out0, extendCircular=code_block_22.out1)
curves_2 = PolyCurve.Curves(polyCurve=offsetMany)

# group: Callout
duplicateView = View.DuplicateView(view=GCKViewsByName, suffix=code_block_11)
# note: Custom Node: archilab
setCropBoxByCurves = archilab.Revit.Views.Views.SetCropBoxByCurves(view=duplicateView, curves=curves_2)

# group: Sheets > INPUT
code_block_23 = CodeBlock { "ANT_E2.3"; }

# group: Sheets > Titleblock list
witryna = TitleblockTypes("_GCK_Table_PW_A3_ZSD_B:_GCK_Table_PW_A3_ZSD_B")
window = TitleblockTypes("_GCK_Table_PW_A3_ZSD_B:_GCK_Table_PW_A3_ZSD_B")
door = TitleblockTypes("_GCK_Table_PW_A4_ZSD:_GCK_Table_PW_A4_ZSD")
join_2 = List.Join(list0=witryna, list1=window, list2=door)

# group: Continue sheets if already exist
categories_4 = Categories("OST_Sheets")
all_elements_of_category_2 = ElementsOfCategory(Category=categories_4)
sheetNumber = Sheet.SheetNumber(sheet=all_elements_of_category_2)
code_block_24 = CodeBlock(x=sheetNumber, y=code_block_23) { DSCore.String.Contains(x + "", y); }
filterByBoolMask_2 = List.FilterByBoolMask(list=all_elements_of_category_2, mask=code_block_24)
sheetNumber_2 = Sheet.SheetNumber(sheet=filterByBoolMask_2.in)
length = String.Length(string=sheetNumber_2)
code_block_25 = CodeBlock(x=length) { x[0]-3; }
code_block_26 = CodeBlock { 3; }
stringGetAtIndex = Custom[StringGetAtIndex](Input_string=sheetNumber_2, Starting_Index=code_block_25, Amount=code_block_26)  # Get symbol at index (first letter in string is at index 0), optional number of symbols after starting index.
maximumItem = List.MaximumItem(list=stringGetAtIndex)
code_block_27 = CodeBlock(x=maximumItem) { x == null ? 0 : x; }

# group: Sheets
ʳʰʸᵗʰᵐ_elements_2 = Rhythm.Revit.Elements.Elements.GetParameterValueByNameTypeOrInstance(element=passNode, parameterName=string)
python_script = Python(IN[0]=ʳʰʸᵗʰᵐ_elements_2, IN[1]=code_block_23, IN[2]=join_2, IN[3]=code_block_27)  # CPython3
# ---------- python_script.python (67 lines) ----------
# Copyright (c) 2024 Jan Kośmiński
#
# Permission is hereby granted, free of charge, to any person obtaining a copy
# of this software and associated documentation files (the "Software"), to deal
# in the Software without restriction, including without limitation the rights
# to use, copy, modify, merge, publish, distribute, sublicense, and/or sell
# copies of the Software, and to permit persons to whom the Software is
# furnished to do so, subject to the following conditions:
# 
# The above copyright notice and this permission notice shall be included in
# all copies or substantial portions of the Software.
#
# The above exclusively applies to files containing this copyright notice, and
# does not apply for the rest of the software package containing these files.
#
# THE SOFTWARE IS PROVIDED "AS IS", WITHOUT WARRANTY OF ANY KIND, EXPRESS OR
# IMPLIED, INCLUDING BUT NOT LIMITED TO THE WARRANTIES OF MERCHANTABILITY,
# FITNESS FOR A PARTICULAR PURPOSE AND NONINFRINGEMENT. IN NO EVENT SHALL THE
# AUTHORS OR COPYRIGHT HOLDERS BE LIABLE FOR ANY CLAIM, DAMAGES OR OTHER
# LIABILITY, WHETHER IN AN ACTION OF CONTRACT, TORT OR OTHERWISE, ARISING FROM,
# OUT OF OR IN CONNECTION WITH THE SOFTWARE OR THE USE OR OTHER DEALINGS IN
# THE SOFTWARE.

# Load the Python Standard and DesignScript Libraries
import sys
import clr
clr.AddReference('ProtoGeometry')
from Autodesk.DesignScript.Geometry import *

# innit
dataEnteringNode = IN
names = IN[0]
project_name = IN[1]
titleblocks = IN[2]
lastnum = int(IN[3])
dict_n = {}
output = []
output2 = []
names_sorted = names.copy()
names_sorted.sort(reverse=False)
if lastnum > 501:
    i = lastnum + 1
else:
    i = 501
for name in names_sorted:
    dict_n[name] = f"{project_name}_PW_AR_X_{i}"
    i += 1
for name in names:
    output.append(dict_n[name])
    x = int(name[0])
# do wprowadzenia jak CPython3 osiagnie wersję 3.10    
#    match x:
#    case 1:
#         output2.append(titleblocks[1])
#    case 2 | 3 | 4:
#         output2.append(titleblocks[2])
#    case 5:
#         output2.append(titleblocks[0])
    if x in range(1,4):
        output2.append(titleblocks[2])
    elif x == 4:
        output2.append(titleblocks[1])
    elif x == 5:
        output2.append(titleblocks[0])
    

OUT = output, output2
# ----------------------------------------
code_block_28 = CodeBlock(x=python_script) { x[0]; x[1]; }
create_sheet = Custom[Create Sheet](sheetName=ʳʰʸᵗʰᵐ_elements_2, sheetNumber=code_block_28.out0, titleBlock=code_block_28.out1)  # package Genius Loci; Creates new sheets.

count = List.Count(list=byStartPointEndPoint)

# group: Schedules > Schedule templates
doors = ScheduleViews("Template_drzwi")
windows = ScheduleViews("Template_okno")
storefront = ScheduleViews("Template_usługa_witryna")
join_3 = List.Join(list0=doors, list1=windows, list2=storefront)

# group: Schedules > isStorefront?
code_block_29 = CodeBlock { "Family"; }
getParameterValueByName_4 = Revit.LinkElement.GetParameterValueByName(linkElement=passNode, parameterName=code_block_29)
code_block_30 = CodeBlock(x=getParameterValueByName_4) { DSCore.String.Contains(x + "", "SFD"); }

# group: Schedules
ʳʰʸᵗʰᵐ_elements_3 = Rhythm.Revit.Elements.Elements.GetParameterValueByNameTypeOrInstance(element=passNode, parameterName=string)
python_script_2 = Python(IN[0]=ʳʰʸᵗʰᵐ_elements_3, IN[1]=join_3, IN[2]=code_block_30)  # CPython3
# ---------- python_script_2.python (61 lines) ----------
# Copyright (c) 2024 Jan Kośmiński
#
# Permission is hereby granted, free of charge, to any person obtaining a copy
# of this software and associated documentation files (the "Software"), to deal
# in the Software without restriction, including without limitation the rights
# to use, copy, modify, merge, publish, distribute, sublicense, and/or sell
# copies of the Software, and to permit persons to whom the Software is
# furnished to do so, subject to the following conditions:
# 
# The above copyright notice and this permission notice shall be included in
# all copies or substantial portions of the Software.
#
# The above exclusively applies to files containing this copyright notice, and
# does not apply for the rest of the software package containing these files.
#
# THE SOFTWARE IS PROVIDED "AS IS", WITHOUT WARRANTY OF ANY KIND, EXPRESS OR
# IMPLIED, INCLUDING BUT NOT LIMITED TO THE WARRANTIES OF MERCHANTABILITY,
# FITNESS FOR A PARTICULAR PURPOSE AND NONINFRINGEMENT. IN NO EVENT SHALL THE
# AUTHORS OR COPYRIGHT HOLDERS BE LIABLE FOR ANY CLAIM, DAMAGES OR OTHER
# LIABILITY, WHETHER IN AN ACTION OF CONTRACT, TORT OR OTHERWISE, ARISING FROM,
# OUT OF OR IN CONNECTION WITH THE SOFTWARE OR THE USE OR OTHER DEALINGS IN
# THE SOFTWARE.

# Load the Python Standard and DesignScript Libraries
import sys
import clr
clr.AddReference('ProtoGeometry')
from Autodesk.DesignScript.Geometry import *

# innit
dataEnteringNode = IN
names = IN[0]
schedules = IN[1]
storefront = UnwrapElement(IN[2])
dict_n = {}
output = []
i = 0;
for name in names:
    x = int(name[0])
    
# do wprowadzenia jak CPython3 osiagnie wersję 3.10    
#    match x:
#    case 1:
#         output2.append(titleblocks[1])
#    case 2 | 3 | 4:
#         output2.append(titleblocks[2])
#    case 5:
#         output2.append(titleblocks[0])
    if x in range(0,4):
        if(storefront[i]):
            output.append(schedules[2])
        else:
            output.append(schedules[0])
    elif x == 4:
        output.append(schedules[1])
    elif x == 5:
        output.append(schedules[2])
    i += 1
    

OUT = output
# ----------------------------------------
duplicateView_2 = View.DuplicateView(view=python_script_2, suffix=ʳʰʸᵗʰᵐ_elements_3)
fields = ScheduleView.Fields(scheduleView=duplicateView_2)
code_block_31 = CodeBlock(schedules=fields) { Revit.Schedules.ScheduleField.Name(schedules) == "Model"; }
filterByBoolMask_3 = List.FilterByBoolMask(list=fields, mask=code_block_31)
flatten_2 = List.Flatten(list=filterByBoolMask_3.in)
code_block_32 = CodeBlock { "Equal"; }
byFieldTypeAndValue = Revit.Schedules.ScheduleFilter.ByFieldTypeAndValue(field=flatten_2, filterType=code_block_32, value=ʳʰʸᵗʰᵐ_elements_3)
addFilters = ScheduleView.AddFilters(scheduleView=duplicateView_2, scheduleFilters=byFieldTypeAndValue, lacing=Shortest)

code_block_33 = CodeBlock(x=code_block_27) { x; }
