# Dynamo graph HVAC_ZONE_ApartmentType.dyn (Dynamo 2.19.3.6394)

categories = Categories("OST_HVAC_Zones")
all_elements_of_category = ElementsOfCategory(Category=categories)

# group: Bool filter
code_block = CodeBlock { "Typ lokalu"; }
getParameterValueByName = Element.GetParameterValueByName(element=all_elements_of_category, parameterName=code_block)
code_block_2 = CodeBlock(x=getParameterValueByName) { x != "U"; }
name = Element.Name(element=all_elements_of_category)
code_block_3 = CodeBlock(x=name) { x != "Default" && x != "TECH"; }
code_block_4 = CodeBlock(x=code_block_2, y=code_block_3) { x && y; }
filterByBoolMask = List.FilterByBoolMask(list=all_elements_of_category, mask=code_block_4)

code_block_5 = CodeBlock { "Typ lokalu"; }
HVACZoneListSpaces = Custom[HVACZoneListSpaces](HVAC_Zone=filterByBoolMask.in)  # Lists spaces from input HVAC Zones
python_script = Python(IN[0]=filterByBoolMask.in, IN[1]=HVACZoneListSpaces)  # CPython3
# ---------- python_script.python (30 lines) ----------
# Load the Python Standard and DesignScript Libraries
import sys
import clr
clr.AddReference('ProtoGeometry')
from Autodesk.DesignScript.Geometry import *

# The inputs to this node will be stored as a list in the IN variables.
dataEnteringNode = IN
zones_list = UnwrapElement(IN[0])
spaces_list = UnwrapElement(IN[1])
count_name_list = ["Pokój", "Sypialnia", "Salon", "Salon z aneksem"]
out =[]
# Place your code below this line
for space_sub, zone in zip(spaces_list, zones_list):
    i = 0
    k_flag = False
    for space in space_sub:
       if space.LookupParameter("Name").AsString() in count_name_list:
           i += 1
       if space.LookupParameter("Name").AsString() == "Kuchnia":
            k_flag = True
            
    if k_flag or i == 1:
        out.append(f"M{i}")
    else:
        out.append(f"M{i}A")
    
    
# Assign your output to the OUT variable.
OUT = out
# ----------------------------------------
setParameterByName = Element.SetParameterByName(element=filterByBoolMask.in, parameterName=code_block_5, value=python_script)
