# Dynamo graph HVAC_Zone_Name_by_values.dyn (Dynamo 2.19.3.6394)

categories = Categories("OST_HVAC_Zones")
all_elements_of_category = ElementsOfCategory(Category=categories)
code_block = CodeBlock { "Name"; }
parameterByName = Parameter.ParameterByName(element=all_elements_of_category, name=code_block)
code_block_2 = CodeBlock(x=parameterByName) { x+""; }
code_block_3 = CodeBlock(x=code_block_2) { x == "Name : Default" ? false : true; }
filterByBoolMask = List.FilterByBoolMask(list=all_elements_of_category, mask=code_block_3)
code_block_4 = CodeBlock { "Name"; }
code_block_5 = CodeBlock { "Nr Budynku"; }
getParameterValueByName = Element.GetParameterValueByName(element=filterByBoolMask.in, parameterName=code_block_5)
trimWhitespace = String.TrimWhitespace(string=getParameterValueByName)
code_block_6 = CodeBlock { "Nr Klatki"; }
getParameterValueByName_2 = Element.GetParameterValueByName(element=filterByBoolMask.in, parameterName=code_block_6)
trimWhitespace_2 = String.TrimWhitespace(string=getParameterValueByName_2)
code_block_7 = CodeBlock { "Nr Kondygnacji"; }
getParameterValueByName_3 = Element.GetParameterValueByName(element=filterByBoolMask.in, parameterName=code_block_7)
trimWhitespace_3 = String.TrimWhitespace(string=getParameterValueByName_3)
code_block_8 = CodeBlock { "Nr na kond."; }
getParameterValueByName_4 = Element.GetParameterValueByName(element=filterByBoolMask.in, parameterName=code_block_8)
trimWhitespace_4 = String.TrimWhitespace(string=getParameterValueByName_4)
code_block_9 = CodeBlock(a=trimWhitespace, b=trimWhitespace_2, c=trimWhitespace_3, d=trimWhitespace_4) { a+"_"+b+"_"+c+"_"+d; }
code_block_10 = CodeBlock(x=code_block_9) { x; }
setParameterByName = Element.SetParameterByName(element=filterByBoolMask.in, parameterName=code_block_4, value=code_block_10)
