# Dynamo graph HVAC_Zone_Parameter_to_spaces.dyn (Dynamo 2.19.3.6394)

python_script = Python()  # CPython3; frozen; unwired: IN[0], IN[1], IN[2]
# ---------- python_script.python (41 lines) ----------
import clr

clr.AddReference("RevitServices")
import RevitServices
from RevitServices.Persistence import DocumentManager
from RevitServices.Transactions import TransactionManager
doc =  DocumentManager.Instance.CurrentDBDocument

clr.AddReference("RevitNodes")
import Revit
clr.ImportExtensions(Revit.Elements)
clr.ImportExtensions(Revit.GeometryConversion)

clr.AddReference("RevitAPI")
from Autodesk.Revit.DB import *


# The inputs to this node will be stored as a list in the IN variables.
my_zone = UnwrapElement(IN[0])
my_space = UnwrapElement(IN[1])
my_param = IN[2]
# Place your code below this line
debuglist = []


TransactionManager.Instance.EnsureInTransaction(doc)
for z in my_zone:
    zs = z.LookupParameter("Name")
    zsv = zs.AsString()
    for s in my_space:
        ss = s.LookupParameter("Zone")
        ssv = ss.AsString()
        if zsv == ssv:
            for p in my_param:
                zpv = z.LookupParameter(p)
                spv = s.LookupParameter(p)
                spv.Set(zpv.AsString())
                debuglist.append(s)
TransactionManager.Instance.TransactionTaskDone()
# Assign your output to the OUT variable.
OUT = debuglist
# ----------------------------------------
categories = Categories("OST_HVAC_Zones")
all_elements_of_category = ElementsOfCategory(Category=categories)
code_block = CodeBlock { "Name"; }
getParameterValueByName = Element.GetParameterValueByName(element=all_elements_of_category, parameterName=code_block)
code_block_2 = CodeBlock(x=getParameterValueByName) { x+""; }
code_block_3 = CodeBlock(x=code_block_2) { x == "Name : Default" ? false : true; }
filterByBoolMask = List.FilterByBoolMask(list=all_elements_of_category, mask=code_block_3)
HVACZoneListSpaces = Custom[HVACZoneListSpaces](HVAC_Zone=filterByBoolMask.in)  # Lists spaces from input HVAC Zones
flatten = List.Flatten(list=HVACZoneListSpaces)
code_block_4 = CodeBlock { ["Nr Budynku", "Nr Mieszkania", "Nr Klatki", "Nr Kondygnacji", "Nr na kond.",  "Typ lokalu"]; }
HVAC_Zone_Parameter_to_spaces = Custom[HVAC_Zone_Parameter_to_spaces](HVACZones=filterByBoolMask.in, Spaces_List_flat=flatten, Parameter_Names=code_block_4)  # Sets given list of parameters to spaces. Names of parameters MUST be the same as hvac zone ones.
