# Dynamo graph OPENING_RZĘDNA_WZGLĘDEM_ZERA.dyn (Dynamo 2.19.3.6394)
# packages: Clockwork for Dynamo 2.x 2.4.0, Genius Loci 2024.5.29

family_types = FamilyTypes("_GCK_Otwor okragly:_GCK_Otwor okragly")
all_elements_of_family_type = ElementsOfFamilyType(Family_Type=family_types)
# note: Custom Node: Clockwork
elevationOfHostLevel = Custom[Element.ElevationOfHostLevel](element=all_elements_of_family_type)  # package Clockwork for Dynamo 2.x; Returns the elevation of the level a given element is associated with
code_block = CodeBlock { "Sill Height"; }
getParameterValueByName = Element.GetParameterValueByName(element=all_elements_of_family_type, parameterName=code_block)
code_block_2 = CodeBlock(el=all_elements_of_family_type, x=elevationOfHostLevel, y=getParameterValueByName) { el; z = (DSCore.Math.Round(x, 2) + DSCore.Math.Round(y, 2))/100; s = "Ho = " + z; DSCore.String.Remove(s,-1,-4); }
code_block_3 = CodeBlock { "Rzędna od zera"; }
setParameterByName = Element.SetParameterByName(element=code_block_2.el, parameterName=code_block_3, value=code_block_2.out3)
family_types_2 = FamilyTypes("_GCK_Otwor prostokatny:_GCK_Otwor prostokatny")
all_elements_of_family_type_2 = ElementsOfFamilyType(Family_Type=family_types_2)
family_types_3 = FamilyTypes("_GCK_Otwór z krata1:45 x 75")
family = FamilyType.Family(familyType=family_types_3)
all_elements_of_family = Custom[All Elements of Family](family=family)  # package Genius Loci; Get the family instances of the given loadable family.
family_types_4 = FamilyTypes("_GCK_Otwór z krata:150 x 245")
family_2 = FamilyType.Family(familyType=family_types_4)
all_elements_of_family_2 = Custom[All Elements of Family](family=family_2)
list_create = List.Create(item0=all_elements_of_family_type_2, item1=all_elements_of_family, item2=all_elements_of_family_2)
flatten = List.Flatten(list=list_create)
elevationOfHostLevel_2 = Custom[Element.ElevationOfHostLevel](element=flatten)
code_block_4 = CodeBlock { "Sill Height"; }
getParameterValueByName_2 = Element.GetParameterValueByName(element=flatten, parameterName=code_block_4)
code_block_5 = CodeBlock(el=flatten, x=elevationOfHostLevel_2, y=getParameterValueByName_2) { el; z = (DSCore.Math.Round(x, 2) + DSCore.Math.Round(y, 2))/100; s = "Hs = " + z; DSCore.String.Remove(s, -1, -4); }
setParameterByName_2 = Element.SetParameterByName(element=code_block_5.el, parameterName=code_block_3, value=code_block_5.out3)
code_block_6 = CodeBlock { "Diameter"; }
getParameterValueByName_3 = Element.GetParameterValueByName(element=all_elements_of_family_type, parameterName=code_block_6)
code_block_7 = CodeBlock(x=getParameterValueByName_3) { x/2; }
code_block_8 = CodeBlock(x=code_block_7, y=getParameterValueByName) { x+y; }
findByName = GlobalParameter.FindByName()  # unwired: name
