# Dynamo graph PARKING_SequenceBySpline_z_nr_pocz.dyn (Dynamo 2.19.3.6394)
# packages: archi-lab.net 2023.213.1722, Data-Shapes 2022.2.105, Data-Shapes 2024.2.114, Clockwork for Dynamo 2.x 2.6.0

# group: Elementy numerowane - np MP
categories = Categories("OST_Parking")
all_elements_of_category = ElementsOfCategory(Category=categories)
geometry = Element.Geometry(element=all_elements_of_category)  # frozen
byUnion = Solid.ByUnion(solids=geometry)

code_block = CodeBlock { "Kliknij przycisk 'Wybierz' aby zaznaczyć krzywą wzdłuż której nastąpi numerowanie"; }
code_block_2 = CodeBlock { "Numeruj"; }
code_block_3 = CodeBlock { "Element"; }
code_block_4 = CodeBlock { "Wybierz"; }
categories_2 = Categories("OST_Lines")
selectmodelelements_data = Custom[SelectModelElements Data](InputName=code_block_3, ButtonText=code_block_4, CategoryFilter=categories_2)  # package Data-Shapes; Creates a Revit element selection input for UI.MultipleInputForm++ . Check out www.data-shapes.net for more infos!
code_block_5 = CodeBlock { "Numer startowy"; "1"; true; }
textbox_data = Custom[TextBox Data](InputName=code_block_5.out0, DefaultText=code_block_5.out1, IsNumberEntry=code_block_5.out2)  # package Data-Shapes; Create Data for TextBox input in UI.MultipleInputForm ++ . Check out www.data-shapes.net for more informations
list_create = List.Create(item0=selectmodelelements_data, item1=textbox_data)
boolean = BoolSelector(true)
multipleinputform = Custom[MultipleInputForm ++](Description_optional=code_block, ButtonText_optional=code_block_2, Inputs=list_create, Toggle=boolean)  # package Data-Shapes; Create a form with multiple inputs. see www.data-shapes.net for tutorials and infos!
code_block_6 = CodeBlock(x=multipleinputform.User_Inputs) { x[0]; x[1]; }

# group: zaznacz spline
curves = Element.Curves(element=code_block_6.out0)

# group: podzial na kawalki
length = Curve.Length(curve=curves)
code_block_7 = CodeBlock(x=length) { x/150; }
pointsAtEqualSegmentLength = Curve.PointsAtEqualSegmentLength(curve=curves, divisions=code_block_7)

# group: Gora - dol translacja
code_block_8 = CodeBlock { 100; }
byCoordinates = Vector.ByCoordinates(z=code_block_8)
subtract = Point.Subtract(point=pointsAtEqualSegmentLength, vectorToSubtract=byCoordinates)
add = Point.Add(point=pointsAtEqualSegmentLength, vectorToAdd=byCoordinates)

boundingBox = Element.BoundingBox(element=all_elements_of_category)
toCuboid = BoundingBox.ToCuboid(boundingBox=boundingBox)

# group: cylinder intersect
code_block_9 = CodeBlock { 20; }
byPointsRadius = Cylinder.ByPointsRadius(startPoint=subtract, endPoint=add, radius=code_block_9)
flatten = List.Flatten(list=byPointsRadius)
doesIntersect = Geometry.DoesIntersect(geometry=flatten, other=toCuboid, lacing=CrossProduct)

# group: get intersect
boolean_2 = BoolSelector(true)
firstIndexOf = List.FirstIndexOf(list=doesIntersect, item=boolean_2, lacing=CrossProduct)
uniqueItems = List.UniqueItems(list=firstIndexOf)

# group: remove empty
code_block_10 = CodeBlock { -1; }
firstIndexOf_2 = List.FirstIndexOf(list=uniqueItems, item=code_block_10)
removeItemAtIndex = List.RemoveItemAtIndex(list=uniqueItems, indices=firstIndexOf_2)
getItemAtIndex = List.GetItemAtIndex(list=all_elements_of_category, index=removeItemAtIndex)

# group: Sprawdzanie parametrów DB i Platforma
code_block_11 = CodeBlock(x=getItemAtIndex) { x; }
code_block_12 = CodeBlock { "Platforma"; "DB"; }
getParameterValueByName = Element.GetParameterValueByName(element=getItemAtIndex, parameterName=code_block_12.out0)
getParameterValueByName_2 = Element.GetParameterValueByName(element=getItemAtIndex, parameterName=code_block_12.out1)
code_block_13 = CodeBlock(mp=getItemAtIndex, dbl=getParameterValueByName, pd=getParameterValueByName_2, number=code_block_6.out1)
# ---------- code_block_13.designscript (62 lines) ----------
mp;
dbl;
pd;
number;
output=[];
output2=[];
output3=[];
output4=[];
z = [Imperative]
{
p1=number-1;
p2=number-1;
p3=number-1;
p4=number-1;
b=0;
	for (a in mp)
	{
		if(dbl[b] == 1)
		{
			if(pd[b] == 1){
							p1=p1+1;
							p2=p1+1;
							p3=p1+2;
							p4=p1+3;
							output[b]=p1;
							output2[b]=p2;
							output3[b]=p3;
							output4[b]=p4;
							p1=p1+3;
							}
							else{
								p1=p1+1;
								p2=p1+1;
								p3=null;
								p4=null;
								output[b]=p1;
								output2[b]=p2;
								output3[b]=p3;
								output4[b]=p4;
								p1=p1+1;
								}
		}
		else{
				p1=p1+1;
				p2=null;
				p3=null;
				p4=null;
				output[b]=p1;
				output2[b]=p2;
				output3[b]=p3;
				output4[b]=p4;
				p2=p1+1;

				}
	b=b+1;

	}

return [output,output2,output3,output4];


};
# ----------------------------------------
code_block_14 = CodeBlock(x=code_block_13.out8) { x == null ? " " : x+""; }

code_block_15 = CodeBlock { "[,]0+"; }
code_block_16 = CodeBlock { ""; }
replaceRegularExpression = Custom[Regex.ReplaceRegularExpression](RegEx=code_block_15, str=code_block_14, Replacement=code_block_16)  # package Clockwork for Dynamo 2.x; Replaces all occurences of a regular expression within a given string (or list of strings) with another string. The syntax for regular expressions is explained at http://ironpython-test.readthedocs.org/en/latest/howto/regex.html

# group: Numerowanko
code_block_17 = CodeBlock { "P1"; "P2"; "P3"; "P4"; }
code_block_18 = CodeBlock(x=replaceRegularExpression) { x[0]; x[1]; x[2]; x[3]; }
setParameterByName = Element.SetParameterByName(element=code_block_11, parameterName=code_block_17.out0, value=code_block_18.out0)
setParameterByName_2 = Element.SetParameterByName(element=code_block_11, parameterName=code_block_17.out1, value=code_block_18.out1)
setParameterByName_3 = Element.SetParameterByName(element=code_block_11, parameterName=code_block_17.out2, value=code_block_18.out2)
setParameterByName_4 = Element.SetParameterByName(element=code_block_11, parameterName=code_block_17.out3, value=code_block_18.out3)

clear_list = Custom[Clear List](input=byUnion@@L2)  # package archi-lab.net; This node will remove all Null and Empty Lists from any list.
