# Dynamo graph SPACE_Numerowanie pomieszczen.dyn (Dynamo 2.19.3.6394)

categories = Categories("OST_HVAC_Zones")  # graph input
all_elements_of_category = ElementsOfCategory(Category=categories)
HVACZoneListSpaces = Custom[HVACZoneListSpaces](HVAC_Zone=all_elements_of_category)  # Lists spaces from input HVAC Zones
space_rank_dictionary = CodeBlock()
# ---------- space_rank_dictionary.designscript (1 lines) ----------
{"Salon" : 1, "Salon z aneksem" : 1, "Usługa" : 1, "Pokój" : 2, "Sypialnia" : 2, "Zaplecze" : 2, "Kuchnia" : 3, "Przedsionek" : 3, "Łazienka":4,  "WC":5, "Garderoba":6, "Wnęka szafowa":6, "Wnęka garderobiana":6, "Wnęka":6, "Pralnia":7, "Korytarz" : 8, "Hol" : 9, "Balkon" : 10, "Taras" : 10, "Loggia" : 10, "Utwardzenie" : 10, "Przedogródek" : 11, "Ogródek" : 11,"Schowek": 12 };
# ----------------------------------------
numberSpacesInZones = Custom[NumberSpacesInZones](SpaceList=HVACZoneListSpaces, RoomDictionary=space_rank_dictionary)  # Numeruje Space wewnątrz lokali zgodnie z rangą podaną w formie Dictionary {"Nazwa pomieszczenia<str>" : <int>} oraz listy obiektów Space z node HVACZoneListSPaces
