# Dynamo graph TAG_Openings.dyn (Dynamo 2.19.3.6394)
# packages: Clockwork for Dynamo 2.x 2.4.0, archi-lab.net 2023.213.1722

# group: który wektor
YAxis = Vector.YAxis()
# note: Custom Node: Clockwork
activeViewFromCurrentDocument = Custom[Document.ActiveViewFromCurrentDocument]()  # package Clockwork for Dynamo 2.x; Gets the active view of the current document
XAxis = Vector.XAxis()

family_types = FamilyTypes("_GCK_Otwor prostokatny:_GCK_Otwor prostokatny")
all_elements_of_family_type = ElementsOfFamilyType(Family_Type=family_types)
# note: Custom Node: archilab
get_host_element = Custom[Get Host Element](hostedElement=all_elements_of_family_type)  # package archi-lab.net; This node will retrieve a host element from hosted element. Ex. feed in door, get wall.

# group: wektor sciany
getLocation = Element.GetLocation(element=get_host_element)
startPoint = Curve.StartPoint(curve=getLocation)
endPoint = Curve.EndPoint(curve=getLocation)
byTwoPoints = Vector.ByTwoPoints(start=startPoint, end=endPoint)

# group: Ktory obrot?
angleWithVector = Vector.AngleWithVector(vector=XAxis, otherVector=byTwoPoints)
code_block = CodeBlock(x=angleWithVector) { (x < 0 ? -x:x); }
code_block_2 = CodeBlock(x=code_block) { (x < 45 ? false:(x > 135 ? false:true)); }

# group: Taguj
boolean = BoolSelector(true)
select_horizontal_text_alignment = HorizontalAlignment("Center")
select_vertical_text_alignment = VerticalAlignment("Middle")
byElement = Tag.ByElement(view=activeViewFromCurrentDocument, element=all_elements_of_family_type, horizontal=code_block_2, addLeader=boolean, horizontalAlignment=select_horizontal_text_alignment, verticalAlignment=select_vertical_text_alignment)

# group: Rodzaj taga
code_block_3 = CodeBlock(x=byElement) { x; }
family_types_2 = FamilyTypes("_GCK_Tag Otworowanie:Comments Prostokątne")  # graph input

code_block_4 = CodeBlock { "Type"; }
setParameterByName = Element.SetParameterByName(element=code_block_3, parameterName=code_block_4, value=family_types_2)
family_types_3 = FamilyTypes("_GCK_Otwor okragly:_GCK_Otwor okragly")
all_elements_of_family_type_2 = ElementsOfFamilyType(Family_Type=family_types_3)

# group: wektor sciany
# note: Custom Node: archilab
get_host_element_2 = Custom[Get Host Element](hostedElement=all_elements_of_family_type_2)
getLocation_2 = Element.GetLocation(element=get_host_element_2)
startPoint_2 = Curve.StartPoint(curve=getLocation_2)
endPoint_2 = Curve.EndPoint(curve=getLocation_2)
byTwoPoints_2 = Vector.ByTwoPoints(start=startPoint_2, end=endPoint_2)

# group: Ktory obrot?
angleWithVector_2 = Vector.AngleWithVector(vector=XAxis, otherVector=byTwoPoints_2)
code_block_5 = CodeBlock(x=angleWithVector_2) { (x < 0 ? -x:x); }
code_block_6 = CodeBlock(x=code_block_5) { (x < 45 ? false:(x > 135 ? false:true)); }

# group: Taguj
boolean_2 = BoolSelector(true)
select_horizontal_text_alignment_2 = HorizontalAlignment("Center")
select_vertical_text_alignment_2 = VerticalAlignment("Middle")
byElement_2 = Tag.ByElement(view=activeViewFromCurrentDocument, element=all_elements_of_family_type_2, horizontal=code_block_6, addLeader=boolean_2, horizontalAlignment=select_horizontal_text_alignment_2, verticalAlignment=select_vertical_text_alignment_2)

# group: Rodzaj taga
code_block_7 = CodeBlock(x=byElement_2) { x; }
family_types_4 = FamilyTypes("_GCK_Tag Otworowanie:Comments Prostokątne")  # graph input

setParameterByName_2 = Element.SetParameterByName(element=code_block_7, parameterName=code_block_4, value=family_types_4)
