# Dynamo graph TAG_Wall Finish.dyn (Dynamo 2.16.2.5624)
# packages: Genius Loci 2021.9.29, WombatDynamo 2.2.0, Clockwork for Dynamo 2.x 2.4.0

# group: który wektor
XAxis = Vector.XAxis()
YAxis = Vector.YAxis()

# group: który wektor
XAxis_2 = Vector.XAxis()
YAxis_2 = Vector.YAxis()

# group: który wektor
XAxis_3 = Vector.XAxis()
YAxis_3 = Vector.YAxis()

# group: który wektor
XAxis_4 = Vector.XAxis()
YAxis_4 = Vector.YAxis()

# group: Get current view and level
activeViewFromCurrentDocument = Custom[Document.ActiveViewFromCurrentDocument]()  # package Clockwork for Dynamo 2.x; Gets the active view of the current document
code_block = CodeBlock { "Associated Level"; }
getParameterValueByName = Element.GetParameterValueByName(element=activeViewFromCurrentDocument, parameterName=code_block)

byName = WombatDynamo.Level.ByName(name=getParameterValueByName)
categories = Categories("OST_Walls")  # graph input
selectByCategoryAndLevel = Custom[SelectByCategoryAndLevel](level=byName, category=categories)  # package Genius Loci; Select Elements by Category and Level. With a document input, use the Collector of Levels node to get the level input. This API filter doesn't work with MEP and Structural Framing elements.

# group: Czy dłuższy niż 100cm
code_block_2 = CodeBlock { "Length"; }
getParameterValueByName_2 = Element.GetParameterValueByName(element=selectByCategoryAndLevel, parameterName=code_block_2)
code_block_3 = CodeBlock(x=getParameterValueByName_2) { x < 100 ? false : true; }

filterByBoolMask = List.FilterByBoolMask(list=selectByCategoryAndLevel, mask=code_block_3)
code_block_4 = CodeBlock(x=filterByBoolMask.in) { x; }

# group: Czy parametr klasa ppoż ma wartość?
code_block_5 = CodeBlock { "Finish 1"; }
getParameterValueByName_3 = Element.GetParameterValueByName(element=filterByBoolMask.in, parameterName=code_block_5)
length = String.Length(string=getParameterValueByName_3)
code_block_6 = CodeBlock(x=length) { x == 0 ? false : true; }

# group: Czy parametr klasa ppoż ma wartość?
code_block_7 = CodeBlock { "Finish 2"; }
getParameterValueByName_4 = Element.GetParameterValueByName(element=filterByBoolMask.in, parameterName=code_block_7)
length_2 = String.Length(string=getParameterValueByName_4)
code_block_8 = CodeBlock(x=length_2) { x == 0 ? false : true; }

code_block_9 = CodeBlock(finish1=code_block_6, finish2=code_block_8) { finish1 == false && finish2 == true ? true : false; }
filterByBoolMask_2 = List.FilterByBoolMask(list=code_block_4, mask=code_block_9)

# group: wektor sciany
getLocation = Element.GetLocation(element=filterByBoolMask_2.in)
startPoint = Curve.StartPoint(curve=getLocation)
endPoint = Curve.EndPoint(curve=getLocation)
byTwoPoints = Vector.ByTwoPoints(start=startPoint, end=endPoint)

# group: Ktory obrot?
angleWithVector = Vector.AngleWithVector(vector=YAxis_3, otherVector=byTwoPoints)
code_block_10 = CodeBlock(x=angleWithVector) { (x < 0 ? -x:x); }
code_block_11 = CodeBlock(x=code_block_10) { (x < 45 ? false:(x > 135 ? false:true)); }

# group: offset
code_block_12 = CodeBlock(x=code_block_11) { x == true ? "0,-10,0" : "-10,0,0"; }
code_block_13 = CodeBlock { ","; }
split = String.Split(string=code_block_12, separator0=code_block_13)
toNumber = String.ToNumber(string=split)
flatten = List.Flatten(list=toNumber)
code_block_14 = CodeBlock { 3; }
code_block_15 = CodeBlock { -2; }
takeEveryNthItem = List.TakeEveryNthItem(list=flatten, n=code_block_14, offset=code_block_15)
code_block_16 = CodeBlock { 3; }
code_block_17 = CodeBlock { -1; }
takeEveryNthItem_2 = List.TakeEveryNthItem(list=flatten, n=code_block_16, offset=code_block_17)
code_block_18 = CodeBlock { 3; }
code_block_19 = CodeBlock { 0; }
takeEveryNthItem_3 = List.TakeEveryNthItem(list=flatten, n=code_block_18, offset=code_block_19)
byCoordinates = Vector.ByCoordinates(x=takeEveryNthItem, y=takeEveryNthItem_2, z=takeEveryNthItem_3)

# group: Taguj
boolean = BoolSelector(true)
select_horizontal_text_alignment = HorizontalAlignment("Center")
select_vertical_text_alignment = VerticalAlignment("Middle")
byElement = Tag.ByElement(view=activeViewFromCurrentDocument, element=filterByBoolMask_2.in, horizontal=code_block_11, addLeader=boolean, horizontalAlignment=select_horizontal_text_alignment, verticalAlignment=select_vertical_text_alignment, offset=byCoordinates)

code_block_20 = CodeBlock(x=byElement) { x; }
code_block_21 = CodeBlock { "Family and Type"; }
family_types = FamilyTypes("Metka_2:2")  # graph input
setParameterByName = Element.SetParameterByName(element=code_block_20, parameterName=code_block_21, value=family_types)
code_block_22 = CodeBlock(finish1=code_block_6, finish2=code_block_8) { finish1 == true && finish2 == true ? true : false; }
filterByBoolMask_3 = List.FilterByBoolMask(list=code_block_4, mask=code_block_22)

# group: wektor sciany
getLocation_2 = Element.GetLocation(element=filterByBoolMask_3.in)
startPoint_2 = Curve.StartPoint(curve=getLocation_2)
endPoint_2 = Curve.EndPoint(curve=getLocation_2)
byTwoPoints_2 = Vector.ByTwoPoints(start=startPoint_2, end=endPoint_2)

# group: Ktory obrot?
angleWithVector_2 = Vector.AngleWithVector(vector=YAxis_2, otherVector=byTwoPoints_2)
code_block_23 = CodeBlock(x=angleWithVector_2) { (x < 0 ? -x:x); }
code_block_24 = CodeBlock(x=code_block_23) { (x < 45 ? false:(x > 135 ? false:true)); }

# group: offset
code_block_25 = CodeBlock(x=code_block_24) { x == true ? "0,-10,0" : "-10,0,0"; }
code_block_26 = CodeBlock { ","; }
split_2 = String.Split(string=code_block_25, separator0=code_block_26)
toNumber_2 = String.ToNumber(string=split_2)
flatten_2 = List.Flatten(list=toNumber_2)
code_block_27 = CodeBlock { 3; }
code_block_28 = CodeBlock { -2; }
takeEveryNthItem_4 = List.TakeEveryNthItem(list=flatten_2, n=code_block_27, offset=code_block_28)
code_block_29 = CodeBlock { 3; }
code_block_30 = CodeBlock { -1; }
takeEveryNthItem_5 = List.TakeEveryNthItem(list=flatten_2, n=code_block_29, offset=code_block_30)
code_block_31 = CodeBlock { 3; }
code_block_32 = CodeBlock { 0; }
takeEveryNthItem_6 = List.TakeEveryNthItem(list=flatten_2, n=code_block_31, offset=code_block_32)
byCoordinates_2 = Vector.ByCoordinates(x=takeEveryNthItem_4, y=takeEveryNthItem_5, z=takeEveryNthItem_6)

# group: Taguj
boolean_2 = BoolSelector(true)
select_horizontal_text_alignment_2 = HorizontalAlignment("Center")
select_vertical_text_alignment_2 = VerticalAlignment("Middle")
byElement_2 = Tag.ByElement(view=activeViewFromCurrentDocument, element=filterByBoolMask_3.in, horizontal=code_block_24, addLeader=boolean_2, horizontalAlignment=select_horizontal_text_alignment_2, verticalAlignment=select_vertical_text_alignment_2, offset=byCoordinates_2)

code_block_33 = CodeBlock(x=byElement_2) { x; }
family_types_2 = FamilyTypes("Metka_3:3")  # graph input
setParameterByName_2 = Element.SetParameterByName(element=code_block_33, parameterName=code_block_21, value=family_types_2)
code_block_34 = CodeBlock(finish1=code_block_6, finish2=code_block_8) { finish1 == false && finish2 == false ? true : false; }
filterByBoolMask_4 = List.FilterByBoolMask(list=code_block_4, mask=code_block_34)

# group: wektor sciany
getLocation_3 = Element.GetLocation(element=filterByBoolMask_4.in)
startPoint_3 = Curve.StartPoint(curve=getLocation_3)
endPoint_3 = Curve.EndPoint(curve=getLocation_3)
byTwoPoints_3 = Vector.ByTwoPoints(start=startPoint_3, end=endPoint_3)

# group: Ktory obrot?
angleWithVector_3 = Vector.AngleWithVector(vector=YAxis_4, otherVector=byTwoPoints_3)
code_block_35 = CodeBlock(x=angleWithVector_3) { (x < 0 ? -x:x); }
code_block_36 = CodeBlock(x=code_block_35) { (x < 45 ? false:(x > 135 ? false:true)); }

# group: offset
code_block_37 = CodeBlock(x=code_block_36) { x == true ? "0,-10,0" : "-10,0,0"; }
code_block_38 = CodeBlock { ","; }
split_3 = String.Split(string=code_block_37, separator0=code_block_38)
toNumber_3 = String.ToNumber(string=split_3)
flatten_3 = List.Flatten(list=toNumber_3)
code_block_39 = CodeBlock { 3; }
code_block_40 = CodeBlock { -2; }
takeEveryNthItem_7 = List.TakeEveryNthItem(list=flatten_3, n=code_block_39, offset=code_block_40)
code_block_41 = CodeBlock { 3; }
code_block_42 = CodeBlock { -1; }
takeEveryNthItem_8 = List.TakeEveryNthItem(list=flatten_3, n=code_block_41, offset=code_block_42)
code_block_43 = CodeBlock { 3; }
code_block_44 = CodeBlock { 0; }
takeEveryNthItem_9 = List.TakeEveryNthItem(list=flatten_3, n=code_block_43, offset=code_block_44)
byCoordinates_3 = Vector.ByCoordinates(x=takeEveryNthItem_7, y=takeEveryNthItem_8, z=takeEveryNthItem_9)

# group: Taguj
boolean_3 = BoolSelector(true)
select_horizontal_text_alignment_3 = HorizontalAlignment("Center")
select_vertical_text_alignment_3 = VerticalAlignment("Middle")
byElement_3 = Tag.ByElement(view=activeViewFromCurrentDocument, element=filterByBoolMask_4.in, horizontal=code_block_36, addLeader=boolean_3, horizontalAlignment=select_horizontal_text_alignment_3, verticalAlignment=select_vertical_text_alignment_3, offset=byCoordinates_3)

code_block_45 = CodeBlock(x=byElement_3) { x; }
family_types_3 = FamilyTypes("Metka_1:1")  # graph input
setParameterByName_3 = Element.SetParameterByName(element=code_block_45, parameterName=code_block_21, value=family_types_3)
code_block_46 = CodeBlock(finish1=code_block_6, finish2=code_block_8) { finish1 == true && finish2 == false ? true : false; }
filterByBoolMask_5 = List.FilterByBoolMask(list=code_block_4, mask=code_block_46)

# group: wektor sciany
getLocation_4 = Element.GetLocation(element=filterByBoolMask_5.in)
startPoint_4 = Curve.StartPoint(curve=getLocation_4)
endPoint_4 = Curve.EndPoint(curve=getLocation_4)
byTwoPoints_4 = Vector.ByTwoPoints(start=startPoint_4, end=endPoint_4)

# group: Ktory obrot?
angleWithVector_4 = Vector.AngleWithVector(vector=YAxis, otherVector=byTwoPoints_4)
code_block_47 = CodeBlock(x=angleWithVector_4) { (x < 0 ? -x:x); }
code_block_48 = CodeBlock(x=code_block_47) { (x < 45 ? false:(x > 135 ? false:true)); }

# group: offset
code_block_49 = CodeBlock(x=code_block_48) { x == true ? "0,-10,0" : "-10,0,0"; }
code_block_50 = CodeBlock { ","; }
split_4 = String.Split(string=code_block_49, separator0=code_block_50)
toNumber_4 = String.ToNumber(string=split_4)
flatten_4 = List.Flatten(list=toNumber_4)
code_block_51 = CodeBlock { 3; }
code_block_52 = CodeBlock { -2; }
takeEveryNthItem_10 = List.TakeEveryNthItem(list=flatten_4, n=code_block_51, offset=code_block_52)
code_block_53 = CodeBlock { 3; }
code_block_54 = CodeBlock { -1; }
takeEveryNthItem_11 = List.TakeEveryNthItem(list=flatten_4, n=code_block_53, offset=code_block_54)
code_block_55 = CodeBlock { 3; }
code_block_56 = CodeBlock { 0; }
takeEveryNthItem_12 = List.TakeEveryNthItem(list=flatten_4, n=code_block_55, offset=code_block_56)
byCoordinates_4 = Vector.ByCoordinates(x=takeEveryNthItem_10, y=takeEveryNthItem_11, z=takeEveryNthItem_12)

# group: Taguj
boolean_4 = BoolSelector(true)
select_horizontal_text_alignment_4 = HorizontalAlignment("Center")
select_vertical_text_alignment_4 = VerticalAlignment("Middle")
byElement_4 = Tag.ByElement(view=activeViewFromCurrentDocument, element=filterByBoolMask_5.in, horizontal=code_block_48, addLeader=boolean_4, horizontalAlignment=select_horizontal_text_alignment_4, verticalAlignment=select_vertical_text_alignment_4, offset=byCoordinates_4)

code_block_57 = CodeBlock(x=byElement_4) { x; }
family_types_4 = FamilyTypes("Metka_2_B:2")  # graph input
setParameterByName_4 = Element.SetParameterByName(element=code_block_57, parameterName=code_block_21, value=family_types_4)
