# Dynamo graph TAG_Wall PPOŻ.dyn (Dynamo 2.16.2.5624)
# packages: Clockwork for Dynamo 2.x 2.4.0, Genius Loci 2023.7.13

# group: który wektor
XAxis = Vector.XAxis()
YAxis = Vector.YAxis()

# note: Custom Node: Clockwork
activeViewFromCurrentDocument = Custom[Document.ActiveViewFromCurrentDocument]()  # package Clockwork for Dynamo 2.x; Gets the active view of the current document
# note: Custom Node: GeniusLociv.2023.7.13
view_level = Custom[View Level](view=activeViewFromCurrentDocument)  # package Genius Loci; Returns the level to which a view is associated.
categories = Categories("OST_Walls")
selectByCategoryAndLevel = Custom[SelectByCategoryAndLevel](level=view_level, category=categories)  # package Genius Loci; Select Elements by Category and Level. With a document input, use the Collector of Levels node to get the level input. This API filter doesn't work with MEP and Structural Framing elements.
minimalna_długośc_ściany_do = IntegerSlider(50, range=0..100 step 1)  # "Minimalna długośc ściany do otagowania"; graph input

# group: Czy dłuższy niż 100cm
code_block = CodeBlock { "Length"; }
getParameterValueByName = Element.GetParameterValueByName(element=selectByCategoryAndLevel, parameterName=code_block)
code_block_2 = CodeBlock(x=getParameterValueByName, y=minimalna_długośc_ściany_do) { x < y ? false : true; }

filterByBoolMask = List.FilterByBoolMask(list=selectByCategoryAndLevel, mask=code_block_2)
wybrana_rodzina_metki = FamilyTypes("_GCK_Wall fire rating tag:_GCK_Wall fire rating tag")  # graph input

# group: Clear old tags
categories_2 = Categories("OST_WallTags")
all_elements_of_category_in_view = ElementsOfCategoryInView(Category=categories_2, View=activeViewFromCurrentDocument)
all_elements_of_family_type = Custom[All Elements of Family Type+](familyType=wybrana_rodzina_metki)  # package Clockwork for Dynamo 2.x; Unlike the built-in node, this node retrieves all placed instances of a given loadable *or* system family type
setIntersection = List.SetIntersection(list1=all_elements_of_category_in_view, list2=all_elements_of_family_type)
delete = Element.Delete(element=setIntersection)

passthrough = Custom[Passthrough](passThrough=filterByBoolMask.in, waitFor=delete)  # package Clockwork for Dynamo 2.x; Forces a sequential order of execution. The node wired into the output of the Passthrough node will be executed *after* the node wired into the waitFor input (e.g. important for some Revit operations). The value of the passThrough input will be passed on to the node wired into the output port of the Passthrough node.

# group: Czy parametr klasa ppoż ma wartość?
code_block_3 = CodeBlock { "Klasa ppoż"; }
getParameterValueByName_2 = Element.GetParameterValueByName(element=filterByBoolMask.in, parameterName=code_block_3)
length = String.Length(string=getParameterValueByName_2)
code_block_4 = CodeBlock(x=length) { x == 0 ? false : true; }

filterByBoolMask_2 = List.FilterByBoolMask(list=passthrough, mask=code_block_4)

# group: wektor sciany
getLocation = Element.GetLocation(element=filterByBoolMask_2.in)
startPoint = Curve.StartPoint(curve=getLocation)
endPoint = Curve.EndPoint(curve=getLocation)
byTwoPoints = Vector.ByTwoPoints(start=startPoint, end=endPoint)

# group: Ktory obrot?
angleWithVector = Vector.AngleWithVector(vector=YAxis, otherVector=byTwoPoints)
code_block_5 = CodeBlock(x=angleWithVector) { (x < 0 ? -x:x); }
code_block_6 = CodeBlock(x=code_block_5) { (x < 45 ? false:(x > 135 ? false:true)); }

# group: Taguj
boolean = BoolSelector(false)
select_horizontal_text_alignment = HorizontalAlignment("Center")
select_vertical_text_alignment = VerticalAlignment("Middle")
byElement = Tag.ByElement(view=activeViewFromCurrentDocument, element=filterByBoolMask_2.in, horizontal=code_block_6, addLeader=boolean, horizontalAlignment=select_horizontal_text_alignment, verticalAlignment=select_vertical_text_alignment)

code_block_7 = CodeBlock(x=byElement) { x; }
code_block_8 = CodeBlock { "Type"; }
setParameterByName = Element.SetParameterByName(element=code_block_7, parameterName=code_block_8, value=wybrana_rodzina_metki)
