# Dynamo graph WYMIARY_Utrwalanie_wymiarow.dyn (Dynamo 2.19.3.6394)
# packages: Clockwork for Dynamo 2.x 2.6.0, Genius Loci 2024.5.29, Rhythm 2023.8.2, Data-Shapes 2024.2.114

# note: Custom Node: Clockwork

categories = Categories("OST_Dimensions")

# group: Warning
code_block = CodeBlock { "Czy o czymś nie zapomniał*ś?"; }
code_block_2 = CodeBlock { "XD"; "Tak"; "Nie"; true; }
multipleinputform = Custom[MultipleInputForm ++](Description_optional=code_block, ButtonText_optional=code_block_2.out2, Inputs=code_block_2.out0, Toggle=code_block_2.out3, CancelButtonText_optional=code_block_2.out1)  # package Data-Shapes; Create a form with multiple inputs. see www.data-shapes.net for tutorials and infos!

passthrough = Custom[Passthrough](passThrough=categories, waitFor=multipleinputform.Was_Run)  # package Clockwork for Dynamo 2.x; Forces a sequential order of execution. The node wired into the output of the Passthrough node will be executed *after* the node wired into the waitFor input (e.g. important for some Revit operations). The value of the passThrough input will be passed on to the node wired into the output port of the Passthrough node.
# note: Custom Node: Clockwork
activeViewFromCurrentDocument = Custom[Document.ActiveViewFromCurrentDocument]()  # package Clockwork for Dynamo 2.x; Gets the active view of the current document
code_block_3 = CodeBlock(x=activeViewFromCurrentDocument) { x; }
all_elements_of_category_in_view = ElementsOfCategoryInView(Category=passthrough, View=code_block_3)
ʳʰʸᵗʰᵐ_dimensions_getcurve = Rhythm.Revit.Elements.Dimensions.GetCurve(dimension=all_elements_of_category_in_view)
list_clean = Custom[List Clean](list=ʳʰʸᵗʰᵐ_dimensions_getcurve)  # package Genius Loci; Removes all Null, Empty and Blank from a list or nested list of lists.
startPoint = Curve.StartPoint(curve=list_clean)
endPoint = Curve.EndPoint(curve=list_clean)
code_block_4 = CodeBlock(startPoints=startPoint, endPoints=endPoint)
# ---------- code_block_4.designscript (11 lines) ----------
startPoints;
endPoints;
z = [Imperative]{
s_count = 0;
out = [];
	for(ePoint in endPoints){
		out[s_count] = DSCore.List.AddItemToFront(startPoints[s_count][0],ePoint);
		s_count = s_count +1;
	}
	return out;
};
# ----------------------------------------
direction = Line.Direction(line=list_clean)

# group: Get and rotate > Get nr [0..x][0]
code_block_5 = CodeBlock { 0; }
getItemAtIndex = List.GetItemAtIndex(list=direction@L2, index=code_block_5)

# group: Get and rotate
plane = Custom[View.Plane](view=code_block_3, lacing=Longest)  # package Clockwork for Dynamo 2.x; Retrieves the plane of a given view
flatten = List.Flatten(list=plane)
normal = Plane.Normal(plane=flatten)
code_block_6 = CodeBlock { 90; }
rotate = Vector.Rotate(vector=getItemAtIndex, axis=normal, degrees=code_block_6, lacing=Longest)

code_block_7 = CodeBlock { 100; }
byStartPointDirectionLength = Line.ByStartPointDirectionLength(startPoint=code_block_4.out2, direction=rotate, length=code_block_7)
byCurve = Custom[DetailCurve.ByCurve+](curve=byStartPointDirectionLength, view=code_block_3)  # package Clockwork for Dynamo 2.x; Creates a detail line based on a given curve. Unlike the OOTB node it can also draw circles.

# group: Get nr [0..x][0]
code_block_8 = CodeBlock { 0; }
getItemAtIndex_2 = List.GetItemAtIndex(list=list_clean@L2, index=code_block_8)

byElements = Dimension.ByElements(view=code_block_3, referenceElements=byCurve, line=getItemAtIndex_2)
string = StringInput("[:\.]")
date_time = DateTime("2025-07-31T08:32:00Z")
code_block_9 = CodeBlock(x=date_time) { x+""; }
code_block_10 = CodeBlock { "_"; }
replaceRegularExpression = Custom[Regex.ReplaceRegularExpression](RegEx=string, str=code_block_9, Replacement=code_block_10)  # package Clockwork for Dynamo 2.x; Replaces all occurences of a regular expression within a given string (or list of strings) with another string. The syntax for regular expressions is explained at http://ironpython-test.readthedocs.org/en/latest/howto/regex.html

# group: Group
join = List.Join(list0=byCurve, list1=byElements)
flatten_2 = List.Flatten(list=join)
name = Element.Name(element=code_block_3)
code_block_11 = CodeBlock(x=name, y=replaceRegularExpression) { x+" wymiary"+y; }
# note: Custom Node: Clockwork
fromElements = Custom[Group.FromElements](elements=flatten_2, groupName=code_block_11)  # package Clockwork for Dynamo 2.x; Creates a group from a list of Revit elements. Unlike the OOTB node, it supports naming the created group directly and also indicates which of the input elements (if any) could not be grouped.

# group: Pin
code_block_12 = CodeBlock { true; }
setPinnedStatus = Element.SetPinnedStatus(element=fromElements.group, pinned=code_block_12)

# group: Warning
code_block_13 = CodeBlock { "Zmień jednostki z powrotem na cm"; }
code_block_14 = CodeBlock { "XD"; "OK"; }
code_block_15 = CodeBlock { true; }
passthrough_2 = Custom[Passthrough](passThrough=code_block_15, waitFor=setPinnedStatus)
multipleinputform_2 = Custom[MultipleInputForm ++](Description_optional=code_block_13, ButtonText_optional=code_block_14.out1, Inputs=code_block_14.out0, Toggle=passthrough_2)

passthrough_3 = Custom[Passthrough](passThrough=all_elements_of_category_in_view, waitFor=setPinnedStatus)
group = Custom[Element.Group](element=passthrough_3)  # package Clockwork for Dynamo 2.x; Retrieves the group an element belongs to (if any)
ungroupElements = Group.UngroupElements(group=group)
passthrough_4 = Custom[Passthrough](passThrough=all_elements_of_category_in_view, waitFor=ungroupElements)
delete = Element.Delete(element=passthrough_4)
list_clean_2 = Custom[List Clean](list=group)
groupType = Group.GroupType(group=list_clean_2)
delete_2 = Element.Delete(element=groupType)
