# Dynamo graph przepisz-parametr-typ-lokalu.dyn (Dynamo 2.17.0.3472)

categories = Categories("OST_HVAC_Zones")
all_elements_of_category = ElementsOfCategory(Category=categories)
code_block = CodeBlock { "Typ lokalu2"; "Typ lokalu"; }
getParameterValueByName = Element.GetParameterValueByName(element=all_elements_of_category, parameterName=code_block.out0)
setParameterByName = Element.SetParameterByName(element=all_elements_of_category, parameterName=code_block.out1, value=getParameterValueByName)
