# Dynamo graph ELEMENT_sum_selected.dyn "ELEMENT_Sum_of_selected_areas" (Dynamo 2.16.2.5624)
# packages: Data-Shapes 2022.2.105

code_block = CodeBlock { "Zaznacz room/space/area do zsumowania"; "OK"; }
selectmodelelements_data = Custom[SelectModelElements Data]()  # package Data-Shapes; Creates a Revit element selection input for UI.MultipleInputForm++ . Check out www.data-shapes.net for more infos!
code_block_2 = CodeBlock { "Properties"; }
code_block_3 = CodeBlock()
# ---------- code_block_3.designscript (3 lines) ----------
["Area",
"Length",
"Volume"];
# ----------------------------------------
code_block_4 = CodeBlock { 0; }
radiobuttons_data = Custom[RadioButtons Data](InputName=code_block_2, Keys=code_block_3, Values=code_block_3, DefaultValueIndex=code_block_4)  # package Data-Shapes; Create radio buttons input for UI.MultipleInputForm ++ .
list_create = List.Create(item0=selectmodelelements_data, item1=radiobuttons_data)
code_block_5 = CodeBlock { true; }
multipleinputform = Custom[MultipleInputForm ++](Description_optional=code_block.out0, ButtonText_optional=code_block.out1, Inputs=list_create, Toggle=code_block_5)  # package Data-Shapes; Create a form with multiple inputs. see www.data-shapes.net for tutorials and infos!
code_block_6 = CodeBlock(x=multipleinputform.User_Inputs) { x[0]; x[1]; }
getParameterValueByName = Element.GetParameterValueByName(element=code_block_6.out0, parameterName=code_block_6.out1)
flatten = List.Flatten(list=getParameterValueByName)
code_block_7 = CodeBlock(areas=flatten)
# ---------- code_block_7.designscript (12 lines) ----------
areas;
z = [Imperative]

{
sum = 0;
	for (area in areas)
		{
		sum =  sum + area;
		};

	return sum;
};
# ----------------------------------------
code_block_8 = CodeBlock(x=code_block_7.out1) { "Sum of area is: "+ x; }
code_block_9 = CodeBlock { "Ok"; }
multipleinputform_2 = Custom[MultipleInputForm ++](Description_optional=code_block_8, ButtonText_optional=code_block_9, Inputs=code_block_8, Toggle=code_block_5)
