# Dynamo graph GROUP_Set_Name.dyn (Dynamo 2.19.3.6394)
# packages: Data-Shapes 2022.2.105, archi-lab.net 2024.217.1024

# group: Grupa
code_block = CodeBlock { "Grupa"; "Zaznacz grupe"; }
categories = Categories("OST_IOSModelGroups")
selectmodelelements_data = Custom[SelectModelElements Data](InputName=code_block.out0, ButtonText=code_block.out1, CategoryFilter=categories)  # package Data-Shapes; Creates a Revit element selection input for UI.MultipleInputForm++ . Check out www.data-shapes.net for more infos!

# group: Mieszkania
code_block_2 = CodeBlock { "Typ mieszkania"; }
code_block_3 = CodeBlock { ["U", "M1", "M1A", "M2", "M2A", "M3", "M3A", "M4", "M4A", "M5", "M5A", "M6", "M6A"]; }
dropdown_data = Custom[DropDown Data](InputName=code_block_2, Keys=code_block_3, Values=code_block_3)  # package Data-Shapes; Create data for DropDown input in UI.MultiInputForm ++ . Check out www.data-shapes.net for more infos.

# group: Inne
code_block_4 = CodeBlock { "Rodzaj elementów"; }
code_block_5 = CodeBlock { ["BELKI","BALKON", "SC-ZEW", "SC-WEW", "KL-SCH", "DACH", "SŁUPY", "TEREN", "KOMIN", "SZACHT"]; }
dropdown_data_2 = Custom[DropDown Data](InputName=code_block_4, Keys=code_block_5, Values=code_block_5)

# group: A czy B
code_block_6 = CodeBlock { ["Mieszkanie", "Inne"]; }
code_block_7 = CodeBlock(b=dropdown_data, a=dropdown_data_2) { [b,a]; }
conditionalinput_data = Custom[ConditionalInput Data](Options=code_block_6, InputGroups_by_Option=code_block_7)  # package Data-Shapes; Allows to create inputs that are enabled/disabled by a condition dor UI.MultipleInputForm++.

code_block_8 = CodeBlock(a=selectmodelelements_data, b=conditionalinput_data) { [a,b]; }
code_block_9 = CodeBlock { true; }
multipleinputform = Custom[MultipleInputForm ++](Inputs=code_block_8, Toggle=code_block_9)  # package Data-Shapes; Create a form with multiple inputs. see www.data-shapes.net for tutorials and infos!

# group: Clean for python use
code_block_10 = CodeBlock { false; }
clean = List.Clean(list=multipleinputform.User_Inputs, preserveIndices=code_block_10)
flatten = List.Flatten(list=clean)

# group: Wspólne
code_block_11 = CodeBlock { "Projekt"; ["ANT","JER","KRA"]; }
dropdown_data_3 = Custom[DropDown Data](InputName=code_block_11.out0, Keys=code_block_11.out1, Values=code_block_11.out1)
code_block_12 = CodeBlock { "Etap"; ["E1", "E2", "E3", "E4", "E5", "E6"]; }
dropdown_data_4 = Custom[DropDown Data](InputName=code_block_12.out0, Keys=code_block_12.out1, Values=code_block_12.out1)
branch_1 = CodeBlock { "Budynek"; ["A", "B", "C", "D", "E", "F", "G", "H", "I", "J", "K"]; }
dropdown_data_5 = Custom[DropDown Data](InputName=branch_1.out0, Keys=branch_1.out1, Values=branch_1.out1)
branch_1_2 = CodeBlock { "Klatka"; 1; 20; }
slider = Custom[Slider](InputName=branch_1_2.out0, Minimum=branch_1_2.out1, Maximum=branch_1_2.out2)  # package Data-Shapes; Creates slider input for UI.MultipleInputForm ++ . Set the step to decimal value if you want a double slider, or to a integer value if you want an integer slider.
code_block_13 = CodeBlock { "Tekst"; }
code_block_14 = CodeBlock { ""; }
textbox_data = Custom[TextBox Data](InputName=code_block_13, DefaultText=code_block_14)  # package Data-Shapes; Create Data for TextBox input in UI.MultipleInputForm ++ . Check out www.data-shapes.net for more informations

list_create = List.Create(item0=dropdown_data_3, item1=dropdown_data_4, item2=dropdown_data_5, item3=slider, item4=textbox_data)
multipleinputform_2 = Custom[MultipleInputForm ++](Inputs=list_create, Toggle=multipleinputform.Was_Run)
rozdzielnia = CodeBlock(y=flatten, x=multipleinputform_2.User_Inputs) { y[0]; y[1]; y[2]; x; }
type_bool_switch = CodeBlock(x=rozdzielnia.out1) { x == "Mieszkanie"; }
worksets = WorksetUi("Definicje Grup")  # graph input
układacz_nazw = Python(IN[0]=rozdzielnia.out0, IN[1]=type_bool_switch, IN[2]=rozdzielnia.out2, IN[3]=rozdzielnia.x, IN[4]=worksets)  # CPython3
# ---------- układacz_nazw.python (58 lines) ----------
### Jan Kośmiński 2024 - 2025 ###

import clr
clr.AddReference("RevitServices")
import RevitServices
from RevitServices.Persistence import DocumentManager
from RevitServices.Transactions import TransactionManager
clr.AddReference("RevitNodes")
import Revit
clr.ImportExtensions(Revit.Elements)
clr.ImportExtensions(Revit.GeometryConversion)
clr.AddReference("RevitAPI")
from Autodesk.Revit.DB import *
doc =  DocumentManager.Instance.CurrentDBDocument
# The inputs to this node will be stored as a list in the IN variables.
def recu_append(namelist, test):
    if test in namelist:
        a = test.rsplit('_', -1)[-1]
        if a.isnumeric():
            a = int(a)
            b = test.rpartition('_')[0]
            newname = f"{b}_{a+1}"
        else:
            newname = f"{test}_1"
        return recu_append(namelist, newname)
    else:
        return test

group = UnwrapElement(IN[0])
appartment = UnwrapElement(IN[1])
type = IN[2]
params = IN[3]
workset = IN[4]
####
output = ""
new_name = ""
#### Grabing existing groups
collector = FilteredElementCollector(doc)
groups = collector.OfClass(Group).ToElements()
gnamelst = []
for g in groups:
    gnamelst.append(g.Name)
gnamelst.sort()

level = group.get_Parameter(BuiltInParameter.GROUP_LEVEL).AsValueString()
if appartment:
    new_name = f"{type}_{params[0]}_{params[1]}_{params[2]}_KL{params[3]}_{level}"
else:
    new_name = f"{params[0]}_{params[1]}_{params[2]}_{type}_KL{params[3]}_{level}"
if params[4] != "": 
    new_name += f"_{params[4]}"
newn = recu_append(gnamelst, new_name)
TransactionManager.Instance.EnsureInTransaction(doc)
group.GroupType.Name = newn
#group.get_Parameter(BuiltInParameter.ELEM_PARTITION_PARAM)Set(workset.Id.ToInt())
TransactionManager.Instance.TransactionTaskDone()

OUT = output
# ----------------------------------------
watch = Watch(układacz_nazw)
code_block_15 = CodeBlock { "M2A_KRA_E2_C_KL2_Kondygnacja +2"; }
recu_fun_teste = Python(IN[0]=code_block_15)  # CPython3; frozen
# ---------- recu_fun_teste.python (41 lines) ----------
import clr
clr.AddReference("RevitServices")
import RevitServices
from RevitServices.Persistence import DocumentManager
from RevitServices.Transactions import TransactionManager
clr.AddReference("RevitNodes")
import Revit
clr.ImportExtensions(Revit.Elements)
clr.ImportExtensions(Revit.GeometryConversion)
clr.AddReference("RevitAPI")
from Autodesk.Revit.DB import *
doc =  DocumentManager.Instance.CurrentDBDocument
dataEnteringNode = IN
test = IN[0]
# Get the current document
doc =  DocumentManager.Instance.CurrentDBDocument

# Create a filtered element collector
collector = FilteredElementCollector(doc)

# Filter for elements of type Group
groups = collector.OfClass(Group).ToElements()
lst =[]
for g in groups:
    lst.append(g.Name)
lst.sort()
def recu_append(namelist, test):
    if test in lst:
        a = test.rsplit('_', -1)[-1]
        if a.isnumeric():
            a = int(a)
            b = test.rpartition('_')[0]
            newname = f"{b}_{a+1}"
        else:
            newname =f"{test}_1"
        return recu_append(namelist, newname)
    else:
        return test

b = recu_append(lst, test)
OUT = b, lst
# ----------------------------------------
