# Dynamo graph HVAC_POW_LOKALI_do_kart_mieszkan.dyn (Dynamo 2.19.3.6394)
# packages: Genius Loci 2023.7.13

python_script = Python()  # CPython3; frozen; unwired: IN[0], IN[1], IN[2]
# ---------- python_script.python (42 lines) ----------
# Jan Kosminski 2023
import clr

clr.AddReference("RevitServices")
import RevitServices
from RevitServices.Persistence import DocumentManager
from RevitServices.Transactions import TransactionManager
doc =  DocumentManager.Instance.CurrentDBDocument

clr.AddReference("RevitNodes")
import Revit
clr.ImportExtensions(Revit.Elements)
clr.ImportExtensions(Revit.GeometryConversion)

clr.AddReference("RevitAPI")
from Autodesk.Revit.DB import *


# The inputs to this node will be stored as a list in the IN variables.
my_zone = UnwrapElement(IN[0])
my_space = UnwrapElement(IN[1])
my_param = IN[2]
# Place your code below this line
debuglist = []


TransactionManager.Instance.EnsureInTransaction(doc)
for z in my_zone:
    zs = z.LookupParameter("Name")
    zsv = zs.AsString()
    for s in my_space:
        ss = s.LookupParameter("Zone")
        ssv = ss.AsString()
        if zsv == ssv:
            for p in my_param:
                zpv = z.LookupParameter(p)
                spv = s.LookupParameter(p)
                spv.Set(zpv.AsString())
                debuglist.append(s)
TransactionManager.Instance.TransactionTaskDone()
# Assign your output to the OUT variable.
OUT = debuglist
# ----------------------------------------
categories = Categories("OST_HVAC_Zones")
all_elements_of_category = ElementsOfCategory(Category=categories)
code_block = CodeBlock { "Name"; }
getParameterValueByName = Element.GetParameterValueByName(element=all_elements_of_category, parameterName=code_block)
code_block_2 = CodeBlock(x=getParameterValueByName) { x+""; }
code_block_3 = CodeBlock(x=code_block_2) { x == "Default" ? false : true; }
filterByBoolMask = List.FilterByBoolMask(list=all_elements_of_category, mask=code_block_3)
HVACZoneListSpaces = Custom[HVACZoneListSpaces](HVAC_Zone=filterByBoolMask.in)  # Lists spaces from input HVAC Zones
code_block_4 = CodeBlock { "Occupiable"; }
getParameterValueByName_2 = Element.GetParameterValueByName(element=HVACZoneListSpaces, parameterName=code_block_4)
code_block_5 = CodeBlock(x=getParameterValueByName_2) { x == 1 ? true : false; }
filterByBoolMask_2 = List.FilterByBoolMask(list=HVACZoneListSpaces, mask=code_block_5)
list_clean = Custom[List Clean](list=filterByBoolMask_2.in)  # package Genius Loci; Removes all Null, Empty and Blank from a list or nested list of lists.

# group: Nazwa zmiennej do wstawienie powierzchni mieszkania
code_block_6 = CodeBlock { "Powierzchnia Lokalu"; }

code_block_7 = CodeBlock { "Area"; }
getParameterValueByName_3 = Element.GetParameterValueByName(element=list_clean, parameterName=code_block_7)
code_block_8 = CodeBlock { 2; }
round = Math.Round(number=getParameterValueByName_3, digits=code_block_8)
sum = Math.Sum(values=round)
python_script_2 = Python(IN[0]=list_clean, IN[1]=sum)  # CPython3
# ---------- python_script_2.python (21 lines) ----------
# Load the Python Standard and DesignScript Libraries
import sys
import clr
clr.AddReference('ProtoGeometry')
from Autodesk.DesignScript.Geometry import *

# The inputs to this node will be stored as a list in the IN variables.
dataEnteringNode = IN
spaces = IN[0]
areas = IN[1]
out = []
i=0;
# Place your code below this line
for area in areas:
    sub = [];
    for zone in spaces[i]:
        sub.append(area)
    i += 1
    out.append(sub)
# Assign your output to the OUT variable.
OUT = out
# ----------------------------------------
setParameterByName = Element.SetParameterByName(element=list_clean, parameterName=code_block_6, value=python_script_2)
