# Dynamo graph HVAC_ZONE_Numerowanie po nr na kond.dyn (Dynamo 2.19.3.6394)

# group: HVAC Zones
categories = Categories("OST_HVAC_Zones")
all_elements_of_category = ElementsOfCategory(Category=categories)

code_block = CodeBlock { "Typ lokalu"; }
getParameterValueByName = Element.GetParameterValueByName(element=all_elements_of_category, parameterName=code_block)
code_block_2 = CodeBlock(x=getParameterValueByName) { x == "" ? false : true; }
filterByBoolMask = List.FilterByBoolMask(list=all_elements_of_category, mask=code_block_2)
getParameterValueByName_2 = Element.GetParameterValueByName(element=filterByBoolMask.in, parameterName=code_block)
code_block_3 = CodeBlock(x=getParameterValueByName_2) { x == "U" ? false : true; }
filterByBoolMask_2 = List.FilterByBoolMask(list=filterByBoolMask.in, mask=code_block_3)
code_block_4 = CodeBlock { "Nr Budynku"; }
getParameterValueByName_3 = Element.GetParameterValueByName(element=filterByBoolMask_2.in, parameterName=code_block_4)
string = StringInput("A")  # graph input
code_block_5 = CodeBlock(x=getParameterValueByName_3, a=string) { x == a; }
filterByBoolMask_3 = List.FilterByBoolMask(list=filterByBoolMask_2.in, mask=code_block_5)
code_block_6 = CodeBlock { "Nr Klatki"; }
getParameterValueByName_4 = Element.GetParameterValueByName(parameterName=code_block_6)  # unwired: element
sortByFunction = List.SortByFunction(list=filterByBoolMask_3.in@L2, sortFunction=getParameterValueByName_4)
groupByFunction = List.GroupByFunction(list=sortByFunction@L2, groupFunction=getParameterValueByName_4)
code_block_7 = CodeBlock { "Nr Kondygnacji"; }
getParameterValueByName_5 = Element.GetParameterValueByName(parameterName=code_block_7)  # unwired: element
sortByFunction_2 = List.SortByFunction(list=groupByFunction@@L2, sortFunction=getParameterValueByName_5)
groupByFunction_2 = List.GroupByFunction(list=sortByFunction_2@L3, groupFunction=getParameterValueByName_5)
flatten = List.Flatten(list=groupByFunction_2)
code_block_8 = CodeBlock { "Nr na kond."; }
getParameterValueByName_6 = Element.GetParameterValueByName(element=groupByFunction_2@@L3, parameterName=code_block_8)
toNumber = String.ToNumber(string=getParameterValueByName_6@@L4)
flatten_2 = List.Flatten(list=toNumber)
sortByKey = List.SortByKey(list=flatten, keys=flatten_2)
code_block_9 = CodeBlock(x=sortByKey.sortedList) { x; }
flatten_3 = List.Flatten(list=code_block_9)
code_block_10 = CodeBlock { "Nr Mieszkania"; }
code_block_11 = CodeBlock { "Nr na kond."; }
getParameterValueByName_7 = Element.GetParameterValueByName(element=flatten_3, parameterName=code_block_11)
count = List.Count(list=getParameterValueByName_7)
code_block_12 = CodeBlock(x=count) { 1..x; }
code_block_13 = CodeBlock(x=code_block_12) { x+""; }
setParameterByName = Element.SetParameterByName(element=flatten_3, parameterName=code_block_10, value=code_block_13)
