# Dynamo graph HVAC_ZONE_Sequence_By_Spline.dyn (Dynamo 2.18.1.5096)
# packages: Clockwork for Dynamo 2.x 2.6.0, Data-Shapes 2024.2.114, Genius Loci 2024.5.29

# note: Custom Node: Clockwork
activeViewFromCurrentDocument = Custom[Document.ActiveViewFromCurrentDocument]()  # package Clockwork for Dynamo 2.x; Gets the active view of the current document

# group: HVAC Zone w danym widoku
categories = Categories("OST_HVAC_Zones")

all_elements_of_categories_in = Custom[All Elements Of Categories in View](Views=activeViewFromCurrentDocument, Categories=categories)  # package Data-Shapes; Retrieves all elements of the given categories in the given view
code_block = CodeBlock(x=all_elements_of_categories_in) { x; }

# group: Space'y widoczne w danym widoku
categories_2 = Categories("OST_MEPSpaces")
all_elements_of_categories_in_2 = Custom[All Elements Of Categories in View](Views=activeViewFromCurrentDocument, Categories=categories_2)

# group: Geometria space'ów
geometry = Element.Geometry(element=all_elements_of_categories_in_2)

isEmpty = List.IsEmpty(list=geometry, lacing=Longest)
filterByBoolMask = List.FilterByBoolMask(list=all_elements_of_categories_in_2, mask=isEmpty)
categories_3 = Categories("OST_Lines")
code_block_2 = CodeBlock { false; }

# group: UI
OPIS = CodeBlock { "Kliknij przycisk 'Wybierz' aby zaznaczyć krzywe wzdłuż której nastąpi numerowanie"; }
run_it_button = CodeBlock { "Numeruj"; }
code_block_3 = CodeBlock { "Element"; }
SELECT = CodeBlock { "Wybierz"; }
# note: Custom Node: Data-Shapesv.2024.2.114
selectmodelelements_data = Custom[SelectModelElements Data](InputName=code_block_3, ButtonText=SELECT, CategoryFilter=categories_3, SelectSingleElement=code_block_2)  # package Data-Shapes; Creates a Revit element selection input for UI.MultipleInputForm++ . Check out www.data-shapes.net for more infos!
toggle_on = CodeBlock { true; }
multipleinputform = Custom[MultipleInputForm ++](Description_optional=OPIS, ButtonText_optional=run_it_button, Inputs=selectmodelelements_data, Toggle=toggle_on)  # package Data-Shapes; Create a form with multiple inputs. see www.data-shapes.net for tutorials and infos!

# group: linia do krzywych
curves = Element.Curves(element=multipleinputform.User_Inputs)

# group: podzial krzywej na kawalki
length = Curve.Length(curve=curves)
code_block_4 = CodeBlock(x=length) { x/150; }
pointsAtEqualSegmentLength = Curve.PointsAtEqualSegmentLength(curve=curves, divisions=code_block_4)

# group: Góra - dół, translacja punktu
code_block_5 = CodeBlock { 80; }
byCoordinates = Vector.ByCoordinates(z=code_block_5)
subtract = Point.Subtract(point=pointsAtEqualSegmentLength, vectorToSubtract=byCoordinates)
add = Point.Add(point=pointsAtEqualSegmentLength, vectorToAdd=byCoordinates)

filterByBoolMask_2 = List.FilterByBoolMask(list=geometry, mask=isEmpty)

# group (continued): Geometria space'ów
flatten = List.Flatten(list=filterByBoolMask_2.out@L3)

# group: cylinder intersect
code_block_6 = CodeBlock { 10; }
byPointsRadius = Cylinder.ByPointsRadius(startPoint=subtract, endPoint=add, radius=code_block_6)
flatten_2 = List.Flatten(list=byPointsRadius)
doesIntersect = Geometry.DoesIntersect(geometry=flatten_2, other=flatten, lacing=CrossProduct)

code_block_7 = CodeBlock { true; }

# group: get intersect
firstIndexOf = List.FirstIndexOf(list=doesIntersect@@L2, item=code_block_7, lacing=CrossProduct)
uniqueItems = List.UniqueItems(list=firstIndexOf)

# group: remove empty
code_block_8 = CodeBlock { -1; }
firstIndexOf_2 = List.FirstIndexOf(list=uniqueItems@L2, item=code_block_8)
removeItemAtIndex = List.RemoveItemAtIndex(list=uniqueItems, indices=firstIndexOf_2)
flatten_3 = List.Flatten(list=removeItemAtIndex)
getItemAtIndex = List.GetItemAtIndex(list=filterByBoolMask.out, index=flatten_3)

# group: GET ZONE PARAM
code_block_9 = CodeBlock { "Zone"; }
getParameterValueByName = Element.GetParameterValueByName(element=getItemAtIndex, parameterName=code_block_9)
uniqueItems_2 = List.UniqueItems(list=getParameterValueByName)
flatten_4 = List.Flatten(list=uniqueItems_2)

code_block_10 = CodeBlock(x=flatten_4) { x != "Default" ? x : null; }
list_clean = Custom[List Clean](list=code_block_10)  # package Genius Loci; Removes all Null, Empty and Blank from a list or nested list of lists.
pętla_parująca_nazwę_z_zonem = CodeBlock(hvac_z=code_block, zone_names=list_clean)
# ---------- pętla_parująca_nazwę_z_zonem.designscript (27 lines) ----------
hvac_z;
zone_names;
output=[];
output2=[];
z = [Imperative]
{
	ic = 0;
	jc = 0;
	for (name in zone_names)
	{
		for (h in hvac_z)
		{
			if (name == h.GetParameterValueByName("Name"))
			{
				jc = jc + 1;
				output[ic] = jc;
				output2[ic] = h;

			};
		};
		ic = ic + 1;
	};

return [output,output2];


};
# ----------------------------------------
output_i_output2 = CodeBlock(x=pętla_parująca_nazwę_z_zonem.out4) { x[0]; x[1]; }
code_block_11 = CodeBlock(x=output_i_output2.out0) { x+""; }

# group: Zmieniany parametr
zmieniany_parametr = CodeBlock { "Nr na kond."; }
setParameterByName = Element.SetParameterByName(element=output_i_output2.out1, parameterName=zmieniany_parametr, value=code_block_11)

code_block_12 = CodeBlock { "Nr Klatki"; }
getParameterValueByName_2 = Element.GetParameterValueByName(parameterName=code_block_12)  # unwired: element
groupByFunction = List.GroupByFunction(list=output_i_output2.out1, groupFunction=getParameterValueByName_2)
code_block_13 = CodeBlock(x=filterByBoolMask.out) { x; }
