# Dynamo graph PURGE_imported_line_patterns.dyn (Dynamo 2.16.1.2727)

code_block = CodeBlock { ["IMPORT", "IMPORT:"]; }
python_script = Python(IN[0]=code_block)  # CPython3
# ---------- python_script.python (41 lines) ----------
import clr
clr.AddReference("RevitAPI")
clr.AddReference("RevitServices")

from Autodesk.Revit.DB import *
from RevitServices.Persistence import DocumentManager
from RevitServices.Transactions import TransactionManager

# current document
doc = DocumentManager.Instance.CurrentDBDocument
# line pattern elements
line_patterns = FilteredElementCollector(doc).OfClass(LinePatternElement).ToElements()
# name and id pairs
nameIdDict = {}
# keyword - string
keywords = [IN[0]] if not isinstance(IN[0], list) else IN[0]
# output (removed line pattern names)
removed = []
# each line from line patterns
for i in line_patterns:
# each word in keywords
        for k in keywords:
# keyword in line pattern name
                if k in i.Name:
# store in dictionary
                        nameIdDict[i.Name] = i.Id

# start transaction
TransactionManager.Instance.EnsureInTransaction(doc)
# each name, id in dictionary
for name, id in list(nameIdDict.items()):
# add to output result
        removed.append(name)
# delete from the document
        doc.Delete(id)

# transaction done
TransactionManager.Instance.TransactionTaskDone()

# output result
OUT = removed
# ----------------------------------------
