# Dynamo graph SPACE_Name_by_elements_inside.dyn (Dynamo 2.19.3.6394)
# packages: Zhukoven.com 2021.2.27, Genius Loci 2023.7.13

# group: Get all spaces
categories = Categories("OST_MEPSpaces")
all_elements_of_category = ElementsOfCategory(Category=categories)

# group: garaż out
element_level = Custom[Element Level](element=all_elements_of_category)  # package Genius Loci; Gets an element's level. Based on a Clockwork's node
elevation = Level.Elevation(level=element_level)
code_block = CodeBlock(x=elevation) { x > -150; }
filterByBoolMask = List.FilterByBoolMask(list=all_elements_of_category, mask=code_block)

# group: Wyfiltrowanie 0> rooms/spaces
area = Space.Area(space=filterByBoolMask.in)
code_block_2 = CodeBlock(x=area) { x > 0; }
filterByBoolMask_2 = List.FilterByBoolMask(list=filterByBoolMask.in, mask=code_block_2)

# group: Wyfiltrowanie komunikacji itp
code_block_3 = CodeBlock { "Name"; }
getParameterValueByName = Element.GetParameterValueByName(element=filterByBoolMask_2.in, parameterName=code_block_3)
code_block_4 = CodeBlock(name=getParameterValueByName) { name == "Korytarz" || name == "Komórka lokatorska" || name == "Klatka schodowa" || name == "Przedsionek" ? false : true; }
filterByBoolMask_3 = List.FilterByBoolMask(list=filterByBoolMask_2.in, mask=code_block_4)

# group: Get all elements of category
categories_2 = Categories("OST_Casework")
all_elements_of_category_2 = ElementsOfCategory(Category=categories_2)
categories_3 = Categories("OST_Furniture")
all_elements_of_category_3 = ElementsOfCategory(Category=categories_3)
list_create = List.Create(item0=all_elements_of_category_2, item1=all_elements_of_category_3)
flatten = List.Flatten(list=list_create)

# group: Filter 1
dozwolone_nazwy = CodeBlock { ["Łóżko", "Szafa", "Kuchenka", "Sofa", "Pralka", "Wanna", "Prysznic", "WC", "_GCK_Sciana_harmonijka", "Szafa wejsciowa"]; }
code_block_5 = CodeBlock { "Family"; }
parameterByName = Parameter.ParameterByName(element=flatten, name=code_block_5)
code_block_6 = CodeBlock(x=parameterByName) { x+""; }
code_block_7 = CodeBlock { 0; 9; }
remove = String.Remove(string=code_block_6, startIndex=code_block_7.out0, count=code_block_7.out1)
filter_out = Python(IN[0]=flatten, IN[1]=dozwolone_nazwy, IN[2]=remove)  # CPython3
# ---------- filter_out.python (26 lines) ----------
# Load the Python Standard and DesignScript Libraries
import sys
import clr
clr.AddReference('ProtoGeometry')
from Autodesk.DesignScript.Geometry import *
import Revit
from Autodesk.Revit.DB import *
import RevitServices
from System.Collections.Generic import *
# The inputs to this node will be stored as a list in the IN variables.
items = UnwrapElement(IN[0])
dopuszczone = IN[1]
names = IN[2]

flist = []

for item, name in zip(items, names):
    for dop in dopuszczone:
        if dop.lower() in name.lower():
            flist.append(item)
      
    
# Place your code below this line

# Assign your output to the OUT variable.
OUT = flist
# ----------------------------------------
code_block_8 = CodeBlock(x=filter_out) { x; }

# group: Points
boundingBox = Element.BoundingBox(element=code_block_8)
centerPoint = Custom[BoundingBox.CenterPoint](boundingBox=boundingBox)  # package Zhukoven.com; Input Bounding Box element to get its center point. This node is little and lightweight, as it doesn't convert bounding box to geometry to get its centroid point.

python_script = Python(IN[0]=filterByBoolMask_3.in, IN[1]=code_block_8, IN[2]=centerPoint)  # CPython3
# ---------- python_script.python (119 lines) ----------
# Load the Python Standard and DesignScript Libraries
import clr
import sys
import operator
clr.AddReference('ProtoGeometry')
from Autodesk.DesignScript.Geometry import *

pyt_path = r'C:\Program Files (x86)\IronPython 2.7\Lib'
sys.path.append(pyt_path)

# Import ToDSType(bool) extension method
clr.AddReference("RevitNodes")
import Revit
clr.ImportExtensions(Revit.Elements)
clr.ImportExtensions(Revit.GeometryConversion)
# Import DocumentManager and TransactionManager
clr.AddReference("RevitServices")
import RevitServices
from RevitServices.Persistence import DocumentManager
from RevitServices.Transactions import TransactionManager

# Import RevitAPI
clr.AddReference("RevitAPI")
import Autodesk
from Autodesk.Revit.DB import *

dataEnteringNode = IN

spaces= UnwrapElement(IN[0])
elements = UnwrapElement(IN[1])
mid_points = UnwrapElement(IN[2])
doc = DocumentManager.Instance.CurrentDBDocument
uiapp = DocumentManager.Instance.CurrentUIApplication
app = uiapp.Application


s_levels = []
e_levels = []

def get_levels(items):
    i_levels = []
    for item in items:
        i_levels.append(item.LookupParameter("Level").AsValueString())
    return i_levels

def sort_by_list(levels, items):
    data = list(zip(levels, items))
    data = sorted(data, key = operator.itemgetter(0))
    a = []
    b = []
    for i in data:
        a.append(i[0])
        b.append(i[1])
    return a, b

def TryGetSpace(family, phase):
        try:
                inSpace = family.Space[phase]
        except:
                inSpace = None
                pass
        return inSpace

def FamiliesInSpace(_space, _families, _points, _doc):
        outList = []
        for family, point in zip(_families, _points):
                pt = point.ToRevitType()

                if _space.IsPointInSpace(pt):
                        outList.append(family)
                else:
                        for phase in _doc.Phases:
                                inSpace = TryGetSpace(family, phase)
                                if inSpace != None and inSpace.ToDSType(True).Name == _space.ToDSType(True).Name:
                                        outList.append(family)
        return outList

e_levels = get_levels(elements)
se_levels, s_items = sort_by_list(e_levels, elements)
se_levels, s_mp = sort_by_list(e_levels, mid_points)
s_levels = get_levels(spaces)
ss_levels, s_spaces = sort_by_list(s_levels, spaces)
unique_space_levels = list(set(ss_levels))
unique_space_levels.sort()
outData = [[] for i in range(len(s_spaces))]
last_index = 0
fam_at_level = []
point_at_level = []
space_at_level = []
outSpace = []

for usl in unique_space_levels:
    fam_at_level *= 0
    space_at_level *= 0
    point_at_level *= 0
    for se_l, s_i, s_p in zip(se_levels, s_items, s_mp):
        if usl == se_l:
            fam_at_level.append(s_i)
            point_at_level.append(s_p)
            
    for ss_l, s_s in zip(ss_levels, s_spaces):
        if usl == ss_l:
            space_at_level.append(s_s)
    
    try:
        errorReport = None
        for index, space in enumerate(space_at_level):
            outData[index + last_index].extend(FamiliesInSpace(space, fam_at_level, point_at_level, doc))
            outSpace.append(space)            
    except:
   # if error accurs anywhere in the process catch it
        import traceback
        errorReport = traceback.format_exc()
    last_index += len(space_at_level)
#Assign your output to the OUT variable
if errorReport == None:
        OUT = outData, outSpace, unique_space_levels
else:
        OUT = errorReport
# ----------------------------------------
code_block_9 = CodeBlock(x=python_script) { x[0]; x[1]; x[2]; }
code_block_10 = CodeBlock(x=code_block_9.out1) { x; }

# group: Elements in space, remove empty from list
code_block_11 = CodeBlock(x=code_block_9.out0) { x; }
code_block_12 = CodeBlock { "Family"; }
parameterByName_2 = Parameter.ParameterByName(element=code_block_11, name=code_block_12)
isEmpty = List.IsEmpty(list=parameterByName_2@L2)
filterByBoolMask_4 = List.FilterByBoolMask(list=parameterByName_2, mask=isEmpty)

# group: Remove spaces 2 match amount
filterByBoolMask_5 = List.FilterByBoolMask(list=code_block_10, mask=isEmpty)
code_block_13 = CodeBlock(x=filterByBoolMask_5.out) { x; }

code_block_14 = CodeBlock { "Name"; }

# group: Sub-lists 2 strings
code_block_15 = CodeBlock(x=filterByBoolMask_4.out) { x+""; }
code_block_16 = CodeBlock { " - "; }
join = String.Join(separator=code_block_16)  # unwired: string0
map = List.Map(list=code_block_15, f_x=join)

flatten_2 = List.Flatten(list=map)
code_block_17 = CodeBlock { "_GCK_Sciana_harmonijka"; }
boolean = BoolSelector(true)
contains = String.Contains(string=flatten_2, searchFor=code_block_17, ignoreCase=boolean)
code_block_18 = CodeBlock { "Łóżko"; }
contains_2 = String.Contains(string=flatten_2, searchFor=code_block_18, ignoreCase=boolean)
wnęka_szafowa = CodeBlock(x=contains, łóżko=contains_2) { x == true && łóżko == false ? "Wnęka szafowa" : ""; }
code_block_19 = CodeBlock { "Szafa"; }
contains_3 = String.Contains(string=flatten_2, searchFor=code_block_19, ignoreCase=boolean)
code_block_20 = CodeBlock { "Sofa"; }
contains_4 = String.Contains(string=flatten_2, searchFor=code_block_20, ignoreCase=boolean)
HOL = CodeBlock(harmonijka=contains, wejściowa=contains_3, lozko=contains_2, sofa=contains_4) { harmonijka == false && wejściowa == true && lozko == false && sofa == false? "Hol" : ""; }
sypialnia_pokój = CodeBlock(lozko=contains_2, sofa=contains_4) { lozko == true && sofa == false ? "Pokój" : ""; }
code_block_21 = CodeBlock { "Kuchenka"; }
contains_5 = String.Contains(string=flatten_2, searchFor=code_block_21, ignoreCase=boolean)
salon_z_a = CodeBlock(x=contains_5, y=contains_4) { x == true && y == true ? "Salon z aneksem" : ""; }
SALON = CodeBlock(x=contains_5, y=contains_4) { x == false && y == true ? "Salon" : ""; }
KUCHNIA = CodeBlock(x=contains_5, y=contains_4) { x == true && y == false ? "Kuchnia" : ""; }
code_block_22 = CodeBlock { "Wanna"; }
contains_6 = String.Contains(string=flatten_2, searchFor=code_block_22, ignoreCase=boolean)
code_block_23 = CodeBlock { "Prysznic"; }
contains_7 = String.Contains(string=flatten_2, searchFor=code_block_23, ignoreCase=boolean)
LAZIENKA = CodeBlock(wanna=contains_6, prysznic=contains_7) { wanna == true || prysznic == true ? "Łazienka" : ""; }
code_block_24 = CodeBlock { "WC"; }
contains_8 = String.Contains(string=flatten_2, searchFor=code_block_24, ignoreCase=boolean)
WC = CodeBlock(WC=contains_8, wanna=contains_6, prysznic=contains_7) { WC == true && wanna == false && prysznic == false ? "WC" : ""; }
code_block_25 = CodeBlock { "Pralka"; }
contains_9 = String.Contains(string=flatten_2, searchFor=code_block_25, ignoreCase=boolean)
pralnia = CodeBlock(wc=contains_8, pralka=contains_9) { wc == false && pralka == true ? "Pralnia" : ""; }
scalanie_list = CodeBlock(c=wnęka_szafowa, x=HOL, y=sypialnia_pokój, z=salon_z_a, v=SALON, b=KUCHNIA, n=LAZIENKA, m=WC, l=pralnia) { c + x + y + z + v + b + n + m + l; }
setParameterByName = Element.SetParameterByName(element=code_block_13, parameterName=code_block_14, value=scalanie_list)
python_script_2 = Python()  # CPython3; frozen; unwired: IN[0]
# ---------- python_script_2.python (39 lines) ----------
# Load the Python Standard and DesignScript Libraries
import clr
import sys
import operator
clr.AddReference('ProtoGeometry')
from Autodesk.DesignScript.Geometry import *

pyt_path = r'C:\Program Files (x86)\IronPython 2.7\Lib'
sys.path.append(pyt_path)

# Import ToDSType(bool) extension method
clr.AddReference("RevitNodes")
import Revit
clr.ImportExtensions(Revit.Elements)

# Import DocumentManager and TransactionManager
clr.AddReference("RevitServices")
import RevitServices
from RevitServices.Persistence import DocumentManager
from RevitServices.Transactions import TransactionManager

# Import RevitAPI
clr.AddReference("RevitAPI")
import Autodesk
from Autodesk.Revit.DB import *


# The inputs to this node will be stored as a list in the IN variables.
dataEnteringNode = IN
geo_list = []
elements = UnwrapElement(IN[0])
for element in elements:
    e_geo = element.GetGeometryObjectFromReference
    geo_list.append(e_geo)

# Place your code below this line

# Assign your output to the OUT variable.
OUT = geo_list
# ----------------------------------------
code_block_26 = CodeBlock { "Szafa wejsciowa"; }
contains_10 = String.Contains(string=flatten_2, searchFor=code_block_26, ignoreCase=boolean)
