# Dynamo graph TAG_Doors.dyn (Dynamo 2.16.2.5624)
# packages: archi-lab.net 2023.213.1722, Clockwork for Dynamo 2.x 2.4.0

# group: który wektor
YAxis = Vector.YAxis()
XAxis = Vector.XAxis()

activeViewFromCurrentDocument = Custom[Document.ActiveViewFromCurrentDocument]()  # package Clockwork for Dynamo 2.x; Gets the active view of the current document
categories = Categories("OST_Doors")  # graph input
byCategoryAndView = archilab.Revit.Selection.Select.ByCategoryAndView(category=categories, view=activeViewFromCurrentDocument)

# group: Taguj
code_block = CodeBlock { true; }
boolean = BoolSelector(false)
select_horizontal_text_alignment = HorizontalAlignment("Center")
select_vertical_text_alignment = VerticalAlignment("Middle")
byElement = Tag.ByElement(view=activeViewFromCurrentDocument, element=byCategoryAndView, horizontal=code_block, addLeader=boolean, horizontalAlignment=select_horizontal_text_alignment, verticalAlignment=select_vertical_text_alignment)

code_block_2 = CodeBlock { "Type"; }
family_types = FamilyTypes("OZNACZENIE_DRZWI_WEWNĘTRZNE:OZNACZENIE")  # graph input
setParameterByName = Element.SetParameterByName(element=byElement, parameterName=code_block_2, value=family_types)
# note: Custom Node: archilab
get_host_element = Custom[Get Host Element](hostedElement=byCategoryAndView)  # package archi-lab.net; This node will retrieve a host element from hosted element. Ex. feed in door, get wall.

# group: wektor sciany
getLocation = Element.GetLocation(element=get_host_element)
startPoint = Curve.StartPoint(curve=getLocation)
endPoint = Curve.EndPoint(curve=getLocation)
byTwoPoints = Vector.ByTwoPoints(start=startPoint, end=endPoint)

# group: Ktory obrot?
angleWithVector = Vector.AngleWithVector(vector=XAxis, otherVector=byTwoPoints)
code_block_3 = CodeBlock(x=angleWithVector) { (x < 0 ? -x:x); }
code_block_4 = CodeBlock(x=code_block_3) { (x < 45 ? false:(x > 135 ? false:true)); }

filterByBoolMask = List.FilterByBoolMask(list=setParameterByName, mask=code_block_4)
code_block_5 = CodeBlock { "Angle"; 270; }
setParameterByName_2 = Element.SetParameterByName(element=filterByBoolMask.in, parameterName=code_block_5.out0, value=code_block_5.out1)
code_block_6 = CodeBlock { "Angle"; 0; }
setParameterByName_3 = Element.SetParameterByName(element=filterByBoolMask.out, parameterName=code_block_6.out0, value=code_block_6.out1)
code_block_7 = CodeBlock { "Klasa ppoż"; }
getParameterValueByName = Element.GetParameterValueByName(element=byCategoryAndView, parameterName=code_block_7)
code_block_8 = CodeBlock(x=getParameterValueByName) { x == ""; }
filterByBoolMask_2 = List.FilterByBoolMask(list=setParameterByName, mask=code_block_8)
filterByBoolMask_3 = List.FilterByBoolMask(list=byCategoryAndView, mask=code_block_8)
code_block_9 = CodeBlock { "Lewe/prawe"; }
getParameterValueByName_2 = Element.GetParameterValueByName(element=filterByBoolMask_3.out, parameterName=code_block_9)
code_block_10 = CodeBlock(x=getParameterValueByName_2) { x == "L" ? true : false; }
filterByBoolMask_4 = List.FilterByBoolMask(list=filterByBoolMask_2.out, mask=code_block_10)
code_block_11 = CodeBlock { "Type"; }
family_types_2 = FamilyTypes("OZNACZENIE_DRZWI_WEWNĘTRZNE:OZNACZENIE_ppoz_P")  # graph input
setParameterByName_4 = Element.SetParameterByName(element=filterByBoolMask_4.out, parameterName=code_block_11, value=family_types_2)
code_block_12 = CodeBlock { "Type"; }
family_types_3 = FamilyTypes("OZNACZENIE_DRZWI_WEWNĘTRZNE:OZNACZENIE_ppoz_L")  # graph input
setParameterByName_5 = Element.SetParameterByName(element=filterByBoolMask_4.in, parameterName=code_block_12, value=family_types_3)
