# Dynamo graph WALL_Finish_By_Space_Name.dyn (Dynamo 2.19.3.6394)
# packages: Clockwork for Dynamo 2.x 2.3.0, archi-lab.net 2020.23.13

# group: Bool mask filter > Get all spaces
categories = Categories("OST_MEPSpaces")
all_elements_of_category = ElementsOfCategory(Category=categories)

# group: Bool mask filter
name = Space.Name(space=all_elements_of_category)
code_block = CodeBlock(name=name) { name == "Ogródek" || name == "Balkon" || name == "Taras" || name == "Loggia" ? false : true; }
filterByBoolMask = List.FilterByBoolMask(list=all_elements_of_category, mask=code_block)

# group: Pomiń nie wstawione w model a zdefiniowane
area = Space.Area(space=filterByBoolMask.in)
code_block_2 = CodeBlock(x=area) { x > 0; }
filterByBoolMask_2 = List.FilterByBoolMask(list=filterByBoolMask.in, mask=code_block_2)

code_block_3 = CodeBlock(x=filterByBoolMask_2.in) { x; }
# note: Custom Node: Clockwork
boundaries = Custom[Room.Boundaries](room=code_block_3)  # package Clockwork for Dynamo 2.x; Gets a list of all boundaries of a given room or area and a corresponding list of the elements that are generating those boundaries.

# group: Usuwam boundary nie będące ścianami
code_block_4 = CodeBlock(x=boundaries.elements) { x; }
# note: Custom Node: archilab
exteriorDirection = Custom[Wall.ExteriorDirection](wall=code_block_4)  # package archi-lab.net; This node returns exterior direction of the wall as a vector.
code_block_5 = CodeBlock(x=exteriorDirection) { x+""; }
code_block_6 = CodeBlock(x=code_block_5) { x == "Not a Wall" ? false : true; }
filterByBoolMask_3 = List.FilterByBoolMask(list=code_block_4, mask=code_block_6)

# group: usuwam zduplikowane ściany z sublist
code_block_7 = CodeBlock(x=filterByBoolMask_3.in) { x; }
uniqueItems = List.UniqueItems(list=code_block_7@@L2)

# group: dead end wall normals
XAxis = Vector.XAxis()
# note: Custom Node: Clockwork
orientation = Custom[Wall.Orientation](wall=uniqueItems)  # frozen; package Clockwork for Dynamo 2.x; Gets the orientation of a given wall instance (normal of the exterior face of the wall). Will *not* work for walls hosted on mass faces or in-place walls.
angleWithVector = Vector.AngleWithVector(vector=XAxis, otherVector=orientation)
code_block_8 = CodeBlock(x=angleWithVector) { x; }
round = Math.Round(number=code_block_8)
code_block_9 = CodeBlock(x=round) { x; }

# group: Centre
getLocation = Element.GetLocation(element=code_block_3)

# group: Sprawdzenie czy VectorY poprawnie rysuje sie w widoku
YAxis = Vector.YAxis()
code_block_10 = CodeBlock { 400; }
byStartPointDirectionLength = Line.ByStartPointDirectionLength(startPoint=getLocation, direction=YAxis, length=code_block_10)  # frozen

code_block_11 = CodeBlock(walls=uniqueItems) { walls; }
code_block_12 = CodeBlock(x=boundaries.curves) { x; }
filterByBoolMask_4 = List.FilterByBoolMask(list=code_block_12, mask=code_block_6)
code_block_13 = CodeBlock(x=filterByBoolMask_4.in) { x; }
uniqueItems_2 = List.UniqueItems(list=code_block_13@@L2)

# group: wyznaczam środek ściany
length = Curve.Length(curve=uniqueItems_2)
code_block_14 = CodeBlock(x=length) { x/2; }
pointAtSegmentLength = Curve.PointAtSegmentLength(curve=uniqueItems_2, segmentLength=code_block_14)

# group: wektor między środkiem pomieszczenia a ściany
byStartPointEndPoint = Line.ByStartPointEndPoint(startPoint=getLocation, endPoint=pointAtSegmentLength)
direction = Line.Direction(line=byStartPointEndPoint)

# group: Vector angle around axis - dziala
YAxis_2 = Vector.YAxis()
ZAxis = Vector.ZAxis()
angleAboutAxis = Vector.AngleAboutAxis(vector=direction, otherVector=YAxis_2, rotationAxis=ZAxis)
code_block_15 = CodeBlock(angle=angleAboutAxis) { angle >= 45 && angle <= 225 ? "Finish 1" : "Finish 2"; }
code_block_16 = CodeBlock(finishes=code_block_15) { finishes; }

# group: Room name 2 strings
code_block_17 = CodeBlock { "Name"; }
parameterByName = Parameter.ParameterByName(element=code_block_3, name=code_block_17)
code_block_18 = CodeBlock(x=parameterByName) { x + ""; }
code_block_19 = CodeBlock { 0; 7; }
remove = String.Remove(string=code_block_18, startIndex=code_block_19.out0, count=code_block_19.out1)

# group: Warunki
code_block_20 = CodeBlock(name=remove) { name == "Salon z aneksem" || name == "Salon" || name == "Pokój" || name == "Hol" || name == "Garderoba" || name == "Wnęka garderobiana" || name == "Kuchnia" ? "W2" : ""; }
code_block_21 = CodeBlock(name=remove) { name == "Łazienka" || name == "WC" ? "W3" : ""; }
code_block_22 = CodeBlock(name=remove) { name == "Korytarz" || name == "Klatka schodowa" || name == "Przedsionek" || name == "Wiatrołap" || name == "Komunikacja" ? "W4" : ""; }
code_block_23 = CodeBlock(name=remove) { name == "Szyb windowy" ? "W5" : ""; }
code_block_24 = CodeBlock(name=remove) { name == "Śmietnik" ? "W6" : ""; }
code_block_25 = CodeBlock(name=remove) { name == "Szacht" ? "W7" : ""; }
code_block_26 = CodeBlock(name=remove) { name == "Szacht oddymiania" ? "W7" : ""; }

# group: Czy to styropian aku?
code_block_27 = CodeBlock { "Family and Type"; }
parameterByName_2 = Parameter.ParameterByName(element=code_block_11, name=code_block_27)
code_block_28 = CodeBlock(x=parameterByName_2) { x+""; }
code_block_29 = CodeBlock { "W4a"; }
contains = String.Contains(string=code_block_28, searchFor=code_block_29)
code_block_30 = CodeBlock(name=contains) { name == true ? "a" : ""; }

code_block_31 = CodeBlock(x=code_block_20, y=code_block_21, z=code_block_22, v=code_block_23, b=code_block_24, n=code_block_25, m=code_block_26, l=code_block_30) { x + y + z + v + b + n + m + l; }
setParameterByName = Element.SetParameterByName(element=code_block_11, parameterName=code_block_16, value=code_block_31)
